# Grasshopper definition Analyze.gh (Grasshopper 1.0.8)
# plug-ins: Imaging Library, MeshEdit Components, Pufferfish, Rhino.Inside for Autodesk Revit
# Script developed by BIMTech Innovations AB

# ----
# Daylight-Factor: Analyze
# Runs daylight analysis for the selected room in Revit.
# Extracts relevant geometry, prepares input, and sends data to the ML server.
# The resulting daylight metrics and heatmap are returned and visualized in Revit.
# 
# Part of the "Daylight Factor Plugin"
# → https://github.com/upskiller-xyz/Daylight-Factor
# Inputs determined from the model
# Transfer of value from another location
panel = Panel("Userinputs")

# ----
# Used to define the domain for encoding. Must be adapted if a different ML model is used.
max_ceiling_over_floor_heigth_in_mm = Panel("5000")

# ---- group: Parameters for recognizing relevant context geometries
distance_of_context_recognition_mm = Panel("500000")
angle_from_the_center_of_the_window_to_d = Panel("""71
-71""")  # "Angle from the center of the window to detect the context (deg)"

# ---- group: Parameters for recognizing relevant Walls, Floors and Roofs
offset_window_in_negativ_z_mm = Panel("1500")
angle1_deg = Panel("80")
angle2_deg = Panel("280")

# ---- group: Selected Room in Revit
active_selection = GraphicalElement()
# USER INPUTS
element = Element(active_selection)

# ----
# Determines test length to determine highest element above room
# 
# [Amount of multiplications of the room heigth of the selected room]
panel_2 = Panel("20")

# ----
# Adapt if you are using the local server for inference and you are using a different ip/port
local_server_ip = Panel("http://127.0.0.1:8081")

# ---- group: Stop if Selection is not a Room
built_in_categories = BuiltInCategories("autodesk.revit.category.local:rooms-1.0.0", SearchPattern="Rooms")
category_filter = CategoryFilter(Categories=built_in_categories, Inverted=False)
filter_elements = FilterElements(Elements=element, Filter=category_filter)
stream_gate = StreamGate(Stream=element, Gate=filter_elements)  # -> Target0, Target1

# ---- group: Parameter for recognizing relevant Balconies
size_of_area_to_search_for_balconies_mm = Panel("5000")

# ---- group: Extract Usersettings from settings_daylight.json
python_3_script = Python3Script(check_input=stream_gate.Target1)  # -> out, multilayerWall, transmissionValue, deletionStatus, cleanedFolderPath, levelElevation, executionMode, writeResults
# ---------- python_3_script: Python ----------
# -*- coding: utf-8 -*-
"""
GHPython Script: Reads JSON settings from 1 level up, clears a target directory.

    Inputs:
        trigger: Connect a button or boolean toggle to run. (Input 'x' by default)
    Outputs:
        multilayerWall: Value of 'multilayer_wall' from JSON.
        transmissionValue: Value of 'transmission_value' from JSON.
        levelElevation: Value of 'level_elevation' from JSON.
        deletionStatus: Status message of the directory clearing operation.
        cleanedFolderPath: Full path of the directory targeted for cleaning.
        executionMode: Decides if Inference runs locally or on a web server
        writeResults: Decitdes if Results are written back to Revit elements
"""
import Rhino
import os
import json
import shutil # Required for rmtree (deleting non-empty folders)
# Access Grasshopper environment automatically via 'ghenv'

# --- Default output values ---
multilayerWall_out = None
transmissionValue_out = None
levelElevation_out = None 
deletionStatus_out = "Script not executed or error occurred."
cleanedFolderPath_out = None
executionMode_out = None
writeResults_out = None

# --- Get Grasshopper document ---
# ghenv is a special variable available in the GHPython editor
ghdoc = ghenv.Component.OnPingDocument()

# --- Main logic ---
if ghdoc is None:
    deletionStatus_out = "Error: Could not access Grasshopper document."
elif not ghdoc.IsFilePathDefined:
    deletionStatus_out = "Error: Grasshopper document must be saved first."
else:
    try:
        # 1. Get current GH document directory
        gh_file_path = ghdoc.FilePath
        gh_dir = os.path.dirname(gh_file_path)

        # 2. Navigate 1 level up
        base_dir = gh_dir
        for _ in range(1):
            parent_dir_check = os.path.dirname(base_dir)
            if parent_dir_check == base_dir: # Prevent infinite loop at root
                raise ValueError("Cannot go up one level from the current path.")
            base_dir = parent_dir_check
        # print("Target base directory: {}".format(base_dir)) # Uncomment for debugging

        # 3. Construct path to JSON and read settings
        settings_file_path = os.path.join(base_dir, "settings_daylight.json")
        # print("Looking for settings file at: {}".format(settings_file_path)) # Uncomment for debugging

        if os.path.exists(settings_file_path):
            try:
                with open(settings_file_path, 'r') as f:
                    settings_data = json.load(f)
                    multilayerWall_out = settings_data.get("multilayer_wall") # Use .get() for safety
                    transmissionValue_out = settings_data.get("transmission_value")
                    levelElevation_out = settings_data.get("level_elevation") # Read level_elevation
                    executionMode_out = settings_data.get("execution_mode")
                    writeResults_out = settings_data.get("write_results")
            except json.JSONDecodeError:
                deletionStatus_out = "Error: Could not decode JSON file."
                # Ensure other outputs are None if JSON is malformed
                multilayerWall_out = None
                transmissionValue_out = None
                levelElevation_out = None
            except Exception as e:
                deletionStatus_out = "Error reading settings file: {}".format(e)
                multilayerWall_out = None
                transmissionValue_out = None
                levelElevation_out = None
        else:
            # Set status only if no previous error occurred during JSON reading
            if deletionStatus_out == "Script not executed or error occurred.":
                deletionStatus_out = "Error: settings_daylight.json not found."
            # Ensure other outputs are None if file not found
            multilayerWall_out = None
            transmissionValue_out = None
            levelElevation_out = None

        # 4. Find "DaylightPrediction" folder and clear contents
        prediction_dir_path = os.path.join(base_dir, "DaylightPrediction")
        cleanedFolderPath_out = prediction_dir_path # Assign path to the new output
        # print("Target directory for cleaning: {}".format(prediction_dir_path)) # Uncomment for debugging

        if os.path.isdir(prediction_dir_path):
            items_deleted_count = 0
            items_failed_count = 0

            for item_name in os.listdir(prediction_dir_path):
                item_path = os.path.join(prediction_dir_path, item_name)
                try:
                    if os.path.isfile(item_path) or os.path.islink(item_path):
                        os.unlink(item_path) # Delete file/link
                        items_deleted_count += 1
                    elif os.path.isdir(item_path):
                        shutil.rmtree(item_path) # Delete directory recursively
                        items_deleted_count += 1
                except Exception as e:
                    print("Failed to delete {}: {}".format(item_path, e)) # Log specific error
                    items_failed_count += 1
            
            # Update status based on deletion results
            current_status = deletionStatus_out # Preserve previous JSON errors if any
            if current_status == "Script not executed or error occurred." or current_status == "Error: settings_daylight.json not found." or "Could not decode JSON file" in current_status or "Error reading settings file" in current_status :
                current_status = "" # Clear default/JSON error if deletion happens or is attempted

            if items_failed_count == 0:
                if items_deleted_count > 0:
                    deletionStatus_out = "{}Successfully deleted {} items from DaylightPrediction.".format(current_status + " " if current_status else "", items_deleted_count)
                else: # Folder was empty
                    deletionStatus_out = "{}DaylightPrediction directory found but was empty.".format(current_status + " " if current_status else "")
            else:
                deletionStatus_out = "{}Deleted {} items, but failed to delete {} items from DaylightPrediction.".format(current_status + " " if current_status else "", items_deleted_count, items_failed_count)

        else:
            # Update status only if directory not found and no prior critical error occurred
            if deletionStatus_out == "Script not executed or error occurred." or deletionStatus_out == "Error: settings_daylight.json not found.":
                # This case implies JSON file wasn't found, so deletionStatus_out already reflects that.
                # We append the directory not found message.
                deletionStatus_out += " DaylightPrediction directory not found."
            elif "Could not decode JSON file" in deletionStatus_out or "Error reading settings file" in deletionStatus_out:
                # JSON error occurred, append directory status
                deletionStatus_out += " Additionally, DaylightPrediction directory not found."
            else: # JSON was likely read successfully, but directory is missing
                deletionStatus_out += " DaylightPrediction directory not found."
                
    except ValueError as ve: # Catches the "Cannot go up..." error
        deletionStatus_out = "Error: {}".format(ve)
        # Reset other outputs on critical path error
        multilayerWall_out = None
        transmissionValue_out = None
        levelElevation_out = None
        cleanedFolderPath_out = None
    except Exception as e: # Catch any other unexpected errors
        import traceback
        deletionStatus_out = "An unexpected error occurred: {}".format(e)
        print(traceback.format_exc()) # Print detailed traceback to Rhino Python console
        # Reset outputs on major error
        multilayerWall_out = None
        transmissionValue_out = None
        levelElevation_out = None
        cleanedFolderPath_out = None

# --- Assign values to Grasshopper component outputs ---
multilayerWall = multilayerWall_out
transmissionValue = transmissionValue_out
levelElevation = levelElevation_out
deletionStatus = deletionStatus_out
cleanedFolderPath = cleanedFolderPath_out
executionMode = executionMode_out
writeResults = writeResults_out
# ---------- end python_3_script ----------

# ---- group: Distance between z=0 and level of ground
number = Number(python_3_script.levelElevation)

# ---- group: Write Data and Results to Revit Elements
data = Data(python_3_script.writeResults)

# ---- group: Execution Mode of Server
data_2 = Data(python_3_script.executionMode)

# ---- group: Path to Save Images
text = Text(python_3_script.cleanedFolderPath)

# ----
# Exterior Wall modelled as a single Wall? >> True
# Exterior Wall modelled as two Wall? >> False
data_3 = Data(python_3_script.multilayerWall)

element_parameter = ElementParameter(Element=stream_gate.Target1, Parameter="Number")  # -> Element, Value
element_passport = ElementPassport(Element=element_parameter.Element)  # -> DocumentGUID, Document, UniqueID, Id

# ---- group: Get all Windows
cluster = Cluster_7()  # -> ids_fromroom, ids_toroom, windows

# ---- group: Get Windows connected to given Room
equality = Equality(FirstNumber=element_passport.Id, SecondNumber=cluster.ids_toroom)  # -> Equality, Inequality
# AUTOMATIC INPUTS FROM
# REVIT DOCUMENT
equality_2 = Equality(FirstNumber=element_passport.Id, SecondNumber=cluster.ids_fromroom)  # -> Equality, Inequality
gate_or = GateOr(A=equality_2.Equality, B=equality.Equality)
cull_pattern = CullPattern(List=cluster.windows, CullPattern=gate_or)

# ---- group: Reset colour from previous analyses
cull_pattern_2 = CullPattern(List=cluster.windows, CullPattern=invert(gate_or))
reset_element_parameter = ResetElementParameter(Element=cull_pattern_2, Parameter="UPSKR_DF")

# ---- group: Specified Room
element_2 = Element(flatten(element_parameter.Element))
element_geometry = ElementGeometry(Elements=element_2)

# ----
# Floors
built_in_categories_2 = BuiltInCategories("autodesk.revit.category.local:floors-1.0.0", SearchPattern="Floors")
category_filter_2 = CategoryFilter(Categories=built_in_categories_2, Inverted=False)
query_elements = QueryElements(Filter=category_filter_2)  # -> Elements, Count
element_location = ElementLocation(Element=query_elements.Elements)  # -> Element, Location, Hand, Facing, WorkPlane
element_3 = Element(query_elements.Elements)
point = Point(element_location.Location)

# ----
# Roofs
built_in_categories_3 = BuiltInCategories("autodesk.revit.category.local:roofs-1.0.0", SearchPattern="Roof")
category_filter_3 = CategoryFilter(Categories=built_in_categories_3, Inverted=False)
query_elements_2 = QueryElements(Filter=category_filter_3)  # -> Elements, Count
element_location_2 = ElementLocation(Element=query_elements_2.Elements)  # -> Element, Location, Hand, Facing, WorkPlane
element_4 = Element(query_elements_2.Elements)
point_2 = Point(element_location_2.Location)

# ---- group: Connected Windows
# Windows
element_5 = Element(flatten(cull_pattern))
element_geometry_2 = ElementGeometry(Elements=element_5)
element_location_3 = ElementLocation(Element=element_5)  # -> Element, Location, Facing
element_host = ElementHost(Element=element_5)
list_length = ListLength(List=element_5)
brep = Brep(element_geometry_2)
point_3 = Point(element_location_3.Location)

# ----
# Room
brep_2 = Brep(element_geometry)

# ---- group: Debugging: Show Window Vector
panel_3 = Panel("10000")  # disabled
amplitude = Amplitude(Vector=element_location_3.Facing, Amplitude=panel_3)  # disabled
vector_display = VectorDisplay(Anchor=element_location_3.Location, Vector=amplitude)  # disabled

# ---- group: Gate Setting
data_4 = Data(data_3)

# ---- group: Geometry of specified Room(s)
brep_3 = Brep(brep_2)

# ---- group: Find Walls same heigth of Window or above (with Offset in negative Z) / Window Location (bottom middle)
point_4 = Point(point_3)

# ---- group: Window Hosts
element_6 = Element(element_host)

# ---- group: Roof Elements
element_7 = Element(element_4)

# ---- group: Floor Elements
element_8 = Element(element_3)

# ----
# Get Room Data
cluster_2 = Cluster(brep=brep_3)  # -> list, list_2, list_3
brep_4 = Brep(cluster_2.list_2)

# ---- group: Room_Height
area = Area(Geometry=cluster_2.list_3)  # -> Area, Centroid
area_2 = Area(Geometry=cluster_2.list_2)  # -> Area, Centroid
deconstruct = Deconstruct(Point=area.Centroid)  # -> XComponent, YComponent, ZComponent
deconstruct_2 = Deconstruct(Point=area_2.Centroid)  # -> XComponent, YComponent, ZComponent
subtraction = Subtraction(A=deconstruct.ZComponent, B=deconstruct_2.ZComponent)

# ---- group: Windows Normal
vector = Vector(element_location_3.Facing)

# ---- group: Window Location
point_5 = Point(element_location_3.Location)

# ----
detail_level = DetailLevel({"Coarse": 1, "Medium": 2, "Fine": 3}, selected="Coarse")

# ---- group: Distance for checking the surroundings
# MODE OF USE
# 
# Mode 1: Create datapoints. Create datapoints
# by saving all files such as encodings, outputs,
# and other feature files. This requires running DF
# and DA (daylight factor and daylight autonomy)
# simulations, so each datapoint takes 2-3
# minutes to generate.
# 
# The interface provides information during this process:
# 
# 
# (seed) Displays the seed of the room being processed
# in each iteration.
# 
# Usage:
# - Ensure that redoEncodingsOnly is set to false.
# - Set the startseed for the seed you want to start from.
# 
# - Specify the directory where the folders will be
# saved temporarily on your computer before being sent
# to the GCP bucket
# - Specify the location of the the .epw file the json with
# the credentials and the name of the GCP bucket where
# the resulting files will be saved.
# - Reset if it is not already set to 0.
# - Press “play” to start the process.
# 
# 
# Mode 2: Re-encoding of all rooms in our dataset
# for both pix2pix and graph2pix. This is
# particularly useful for testing new encoding
# strategies without the need to rerun time-
# consuming simulations.
# How to use it:
# 
#  same as model 1 except you neet to
# Activate the mode by setting the toggle to true.
# 
# The interface provides information during this process:
# 
# (number of iterations) Shows the total number
# of iterations required, which corresponds to the
# number of rooms in the dataset.
# (current iteration)
# Indicates the current iteration
# number.
# Continue the process until the number
# shown in (current iteration) matches the total in
# (number of iterations). This indicates that all
# rooms have been re-encoded.
number_2 = Number(distance_of_context_recognition_mm)

# ---- group: Angles for checking the surroundings
number_3 = Number(angle_from_the_center_of_the_window_to_d)

# ---- group: Z Heigth of Floors over 0
number_4 = Number(deconstruct_2.ZComponent)

# ---- group: Room Heigth
number_5 = Number(subtraction)

# ---- group: Z Heigth of Ceiling over 0
# EXTERNAL WALLS
number_6 = Number(deconstruct.ZComponent)

# ---- group: Geometry of connected Window(s)
brep_5 = Brep(simplify(brep))

# ---- group: Geometry of connected Window
brep_6 = Brep(simplify(brep))

# ---- group: Room Ceiling Heigth over 0
number_7 = Number(number_6)

# ---- group: Filter out floors and roof beyond the room
element_geometry_3 = ElementGeometry(Elements=element_7)  # -> flatten(Geometry)
element_parameter_2 = ElementParameter(Element=element_8, Parameter="Level")  # -> Element, Value
element_parameter_3 = ElementParameter(Element=element_8, Parameter="Height Offset From Level")  # -> Element, Value
area_3 = Area(Geometry=element_geometry_3)  # -> Area, Centroid
element_parameter_4 = ElementParameter(Element=element_parameter_2.Value, Parameter="Elevation")  # -> Element, Value
deconstruct_3 = Deconstruct(Point=area_3.Centroid)  # -> XComponent, YComponent, ZComponent
addition = Addition(A=element_parameter_4.Value, B=element_parameter_3.Value)
larger_than = LargerThan(FirstNumber=addition, SecondNumber=number_7)  # -> LargerThan, OrEqualTo
larger_than_2 = LargerThan(FirstNumber=deconstruct_3.ZComponent, SecondNumber=number_7)  # -> LargerThan, OrEqualTo
cull_pattern_3 = CullPattern(List=element_8, CullPattern=larger_than.LargerThan)
cull_pattern_4 = CullPattern(List=element_geometry_3, CullPattern=larger_than_2.LargerThan)
element_geometry_4 = ElementGeometry(Elements=cull_pattern_3)  # -> flatten(Geometry)

# ---- group: Size BoundingBox
number_8 = Number(size_of_area_to_search_for_balconies_mm)

# ----
midpoint = Slider(0.5, range=0..10)
construct_point = ConstructPoint(XCoordinate=midpoint, YCoordinate=midpoint, ZCoordinate=0)

# ---- group: Vector Windows Dir
vector_2 = Vector(element_location_3.Facing)

# ---- group: Floor Room
brep_7 = Brep(simplify(brep_4))

# ---- group: Handling by one or more windows per room / Number of connected Windows
number_9 = Number(list_length)

# ----
# Determine highest element
# (roof or florrslab) above room
merge = Merge(Data1=cull_pattern_4, Data2=element_geometry_4)  # -> flatten(Result)

# ---- group: Geometry of specified Room(s)
brep_8 = Brep(brep_2)

# ---- group: Highest Element over room / Room Height
number_10 = Number(number_5)

# ---- group: Highest Element over room / Determines test length for highest element above room
number_11 = Number(panel_2)

# ---- group: Highest Element over room / Centroid of Room
point_6 = Point(area_2.Centroid)

# ---- group: Highest Element over room
unit_z = UnitZ(Factor=1)
multiplication = Multiplication(A=number_10, B=number_11)
line_sdl = LineSDL(Start=point_6, Direction=unit_z, Length=multiplication)
brep_line = BrepLine(Brep=merge, Line=line_sdl, LimitToFirst=False)  # -> Curves, Points
deconstruct_4 = Deconstruct(Point=brep_line.Points)  # -> XComponent, YComponent, ZComponent
bounds = Bounds(Numbers=flatten(deconstruct_4.ZComponent))
deconstruct_domain = DeconstructDomain(Domain=bounds)  # -> Start, End
number_12 = Number(deconstruct_domain.End)

# ---- group: Highlight Element
# PREFILTERING GEOMETRIES AND
# INFORMATION PROCESSING
cull_pattern_5 = CullPattern(List=element_7, CullPattern=larger_than_2.LargerThan)
merge_2 = Merge(Data1=cull_pattern_3, Data2=cull_pattern_5)  # -> flatten(Result)
equality_3 = Equality(FirstNumber=deconstruct_4.ZComponent, SecondNumber=deconstruct_domain.End)  # -> Equality, Inequality
mass_addition = MassAddition(Input=equality_3.Equality)  # -> Result, PartialResults
cull_pattern_6 = CullPattern(List=graft(merge_2), CullPattern=mass_addition.Result)  # -> flatten(List)

# ---- group: Centroid of Room
point_7 = Point(area_2.Centroid)

# ---- group: Floor Heigth of Room
number_13 = Number(number_4)

# ---- group: Host Walls
element_9 = Element(element_host)

# ---- group: Window Direction
vector_3 = Vector(vector)

# ---- group: Gate Settings
data_5 = Data(data_3)

# ---- group: Extend sill to a second wall if given / Window Direction
vector_4 = Vector(vector)

# ---- group: 128 Rays
brep_9 = Brep([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])  # disabled

# ---- group: 64 Rays
brep_10 = Brep([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])

# ---- group: Number of connected Windows
number_14 = Number(list_length)

# ---- group: Distance between z=0 and level of Terrain
number_15 = Number(number)

# ---- group: Z Heigth of Floors over 0
number_16 = Number(number_4)

# ---- group: Number of connected Windows
number_17 = Number(list_length)

# ---- group: Room Floor
brep_11 = Brep(brep_4)

# ---- group: Fixed value taken from original script
data_6 = Data(max_ceiling_over_floor_heigth_in_mm)

# ---- group: Heigth_Roof
number_18 = Number(number_12)

# ---- group: Z Heigth of Floors over 0
number_19 = Number(number_4)

# ---- group: Room Heigth
number_20 = Number(number_5)

# ---- group: Path
text_2 = Text(text)

# ----
# Prepare Translation vector and file names
translation_of_analysis_area_in_mm = Panel("20000")
series = Series(Start=0, Step=translation_of_analysis_area_in_mm, Count=number_17)
series_2 = Series(Start=0, Step=1, Count=number_17)
unit_x = UnitX(Factor=series)
concatenate = Concatenate(Path=text_2, Slash="\", Floorplan="floorplan", Number=series_2, PNG=".png")  # -> simplify(graft(Result))
vector_5 = Vector(unit_x)

# ---- group: Vector to Move Embedding
vector_6 = Vector(vector_5)

# ---- group: Room_Floor
brep_12 = Brep(brep_4)

# ---- group: Translation Vector
vector_7 = Vector(simplify(graft(vector_5)))

# ---- group: Room Floor
brep_13 = Brep(brep_4)

# ---- group: Vector to Move Embedding
vector_8 = Vector(vector_5)

# ----
# Encoding Area(s)
panel_4 = Panel("1000")  # disabled
frame = Brep(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)  # disabled
brep_14 = Brep(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)
scale = Scale(Geometry=frame, Center=Point(0, 0, 0), Factor=panel_4)  # -> Geometry, Transform; disabled
# ENCODING
move = Move(Geometry=brep_14, Motion=vector_8)  # -> simplify(graft(Geometry)), Transform

brep_15 = Brep(flatten(move.Geometry))

# ---- group: Filepath
text_3 = Text(concatenate)

# ---- group: Number of Windows
integer = Integer(list_length)  # disabled

# ---- group: Testing Areas
brep_16 = Brep(move.Geometry)  # disabled

# ----
panel_5 = Panel("5")  # disabled

# ---- group: Filepath
text_4 = Text(text)  # disabled

# ---- group: Execution Mode of Server
data_7 = Data(data_2)  # disabled

# ---- group: Number of Images
number_21 = Number(list_length)  # disabled

# ---- group: Local Server IP
text_5 = Text(local_server_ip)  # disabled

# ---- group: Analysis Areas
brep_17 = Brep(brep_14)

# ---- group: Write Data and Results to Revit Elements
data_8 = Data(data)

# ---- group: Selected Room
# when this component writes the area value to the room, it ungroups the whole apartment!
element_10 = Element(element)

# ----
# External Walls
built_in_categories_4 = BuiltInCategories("autodesk.revit.category.local:walls-1.0.0", SearchPattern="Walls")
category_filter_4 = CategoryFilter(Categories=built_in_categories_4, Inverted=False)
query_elements_3 = QueryElements(Filter=category_filter_4)  # -> Elements, Count

# ---- group: Filter Elements by Type Parameter
cluster_3 = Cluster_8(relay=query_elements_3.Elements, parameter="Function", pattern="Exterior")

# ----
element_location_4 = ElementLocation(Element=cluster_3)  # -> Element, Location, Hand, Facing, WorkPlane
point_8 = Point(element_location_4.Location)
element_11 = Element(cluster_3)

# ---- group: External Walls
element_12 = Element(element_11)

# ---- group: Find Walls same heigth of Window or above (with Offset in negative Z) / Location External Walls
# Determine Visible Walls from Windows
point_9 = Point(point_8)

# ---- group: Find Walls same heigth of Window or above (with Offset in negative Z)
deconstruct_5 = Deconstruct(Point=point_4)  # -> XComponent, YComponent, ZComponent
deconstruct_6 = Deconstruct(Point=point_9)  # -> XComponent, YComponent, ZComponent
bounds_2 = Bounds(Numbers=deconstruct_5.ZComponent)
deconstruct_domain_2 = DeconstructDomain(Domain=bounds_2)  # -> Start, End
number_22 = Number(offset_window_in_negativ_z_mm)
expression = Expression(
    wall_z=deconstruct_6.ZComponent,
    window_z=deconstruct_domain_2.Start,
    offset=number_22,
    Expression="wall_z > (window_z - offset)")

# ----
# Roofs
point_10 = Point(point_2)
deconstruct_7 = Deconstruct(Point=point_10)  # -> XComponent, YComponent, ZComponent
expression_2 = Expression(roof_z=deconstruct_7.ZComponent, window_z=deconstruct_domain_2.Start, offset=number_22, Expression="roof_z > window_z")
element_13 = Element(element_4)
cull_pattern_7 = CullPattern(List=element_13, CullPattern=expression_2)
detail_level_2 = DetailLevel({"Coarse": 1, "Medium": 2, "Fine": 3}, selected="Coarse")
element_geometry_5 = ElementGeometry(Elements=cull_pattern_7, DetailLevel=detail_level_2)
settings_speed = SettingsSpeed()
mesh_brep = MeshBrep(Brep=element_geometry_5, Settings=settings_speed)
mesh = Mesh(mesh_brep)
element_14 = Element(cull_pattern_7)

# ---- group: Exclude floor slabs below the selection
point_11 = Point(point)
deconstruct_8 = Deconstruct(Point=point_11)  # -> XComponent, YComponent, ZComponent
expression_3 = Expression(floor_z=deconstruct_8.ZComponent, window_z=deconstruct_domain_2.Start, offset=number_22, Expression="floor_z > window_z")
element_15 = Element(element_3)
cull_pattern_8 = CullPattern(List=element_15, CullPattern=expression_3)

# ---- group: Filter / Wall Elements
element_16 = Element(element_11)

# ---- group: Filter
cull_pattern_9 = CullPattern(List=element_16, CullPattern=expression)

# ---- group: Create Vectors from Window Points to all Wall Points (Cartesian Product)
end_points = EndPoints(Curve=cull_pattern_9)  # -> Start, End
cross_reference = CrossReference(ListListA=point_4, ListListB=end_points.End, CrossMode=1)  # -> ListListA, ListListB
cross_reference_2 = CrossReference(ListListA=point_4, ListListB=end_points.Start, CrossMode=1)  # -> ListListA, ListListB
vector_2pt = Vector2Pt(PointA=cross_reference.ListListA, PointB=cross_reference.ListListB, Unitize=False)  # -> Vector, Length
vector_2pt_2 = Vector2Pt(PointA=cross_reference_2.ListListA, PointB=cross_reference_2.ListListB, Unitize=False)  # -> Vector, Length
list_length_2 = ListLength(List=point_4)

# ---- group: Check Visibility / Check if Vector Window-Wall is under defined Angle to Windows Vector
partition_list = PartitionList(List=vector_2pt.Vector, Size=list_length_2)
partition_list_2 = PartitionList(List=vector_2pt_2.Vector, Size=list_length_2)
deconstruct_vector = DeconstructVector(Vector=partition_list)  # -> XComponent, YComponent, ZComponent
deconstruct_vector_2 = DeconstructVector(Vector=partition_list_2)  # -> XComponent, YComponent, ZComponent
vector_xyz = VectorXYZ(XComponent=deconstruct_vector.XComponent, YComponent=deconstruct_vector.YComponent, ZComponent=0)  # -> Vector, Length
vector_xyz_2 = VectorXYZ(XComponent=deconstruct_vector_2.XComponent, YComponent=deconstruct_vector_2.YComponent, ZComponent=0)  # -> Vector, Length
vector_9 = Vector(simplify(vector_xyz.Vector))
vector_10 = Vector(simplify(vector_xyz_2.Vector))
angle = Angle(VectorA=vector_9, VectorB=vector_2)  # -> Angle, Reflex
angle_2 = Angle(VectorA=vector_10, VectorB=vector_2)  # -> Angle, Reflex
degrees = Degrees(Radians=angle_2.Angle)
degrees_2 = Degrees(Radians=angle.Angle)
number_23 = Number(angle2_deg)
number_24 = Number(angle1_deg)
expression_4 = Expression(calc_angle=degrees_2, angle1=number_24, angle2=number_23, Expression="(calc_angle < angle1)  or (calc_angle > angle2)")
expression_5 = Expression(calc_angle=degrees, angle1=number_24, angle2=number_23, Expression="(calc_angle < angle1)  or (calc_angle > angle2)")
mass_addition_2 = MassAddition(Input=expression_4)  # -> Result, PartialResults
mass_addition_3 = MassAddition(Input=expression_5)  # -> Result, PartialResults
larger_than_3 = LargerThan(FirstNumber=mass_addition_2.Result, SecondNumber="0")  # -> flatten(LargerThan), OrEqualTo
larger_than_4 = LargerThan(FirstNumber=mass_addition_3.Result, SecondNumber="0")  # -> flatten(LargerThan), OrEqualTo
gate_or_2 = GateOr(A=larger_than_4.LargerThan, B=larger_than_3.LargerThan)

# ---- group: Wall Elements
point_12 = Point(point_8)

# ---- group: Wall Facing Direction
vector_11 = Vector(element_location_4.Facing)

# ---- group: Wall Hand Orientation
vector_12 = Vector(element_location_4.Hand)

# ---- group: Geometry BBox as Mesh
cull_pattern_10 = CullPattern(List=vector_12, CullPattern=expression)
cull_pattern_11 = CullPattern(List=point_12, CullPattern=expression)
cull_pattern_12 = CullPattern(List=vector_11, CullPattern=expression)
cull_pattern_13 = CullPattern(List=cull_pattern_9, CullPattern=gate_or_2)
cull_pattern_14 = CullPattern(List=cull_pattern_11, CullPattern=gate_or_2)
cull_pattern_15 = CullPattern(List=cull_pattern_10, CullPattern=gate_or_2)
cull_pattern_16 = CullPattern(List=cull_pattern_12, CullPattern=gate_or_2)
construct_plane = ConstructPlane(Origin=cull_pattern_14, XAxis=cull_pattern_15, YAxis=cull_pattern_16)
bounding_box = BoundingBox(Content=graft(cull_pattern_13), Plane=graft(construct_plane))  # -> flatten(Box), Box_2
mesh_2 = Mesh(bounding_box.Box)
element_17 = Element(cull_pattern_13)

# ---- group: Roofs
mesh_3 = Mesh(mesh)

# ---- group: MESH Walls
mesh_4 = Mesh(mesh_2)

# ----
# Get Information of Surroundings
built_in_categories_5 = BuiltInCategories("autodesk.revit.category.family:site-1.0.0", SearchPattern="Site")
category_filter_5 = CategoryFilter(Categories=built_in_categories_5, Inverted=False)
query_elements_4 = QueryElements(Filter=category_filter_5, Limit=100)  # -> Elements, Count
element_geometry_6 = ElementGeometry(Elements=query_elements_4.Elements, DetailLevel=detail_level)  # -> flatten(Geometry)

# ----
# Get Information of second exterior Walls
stream_gate_2 = StreamGate(Stream=element_12, Gate=data_4)  # -> Target0, Target1
stream_gate_3 = StreamGate(Stream=element_6, Gate=data_4)  # -> Target0, Target1
bboxscale = Slider(5, range=0..20)
element_18 = Element(graft(stream_gate_3.Target0))

# ---- group: Filter Elements by Proximity
cluster_4 = Cluster_10(relay=stream_gate_2.Target0, content=stream_gate_3.Target0, scale_x=bboxscale, scale_y=bboxscale)  # -> list_2, list

# ---- group: Filter Walls parallel to Window Hosts
cluster_5 = Cluster_9(element=element_18, relay=cluster_4.list, list=cluster_4.list_2)  # -> list_2, list_3

# ---- group: Filter out Window Hosts from Wall List
element_parameter_5 = ElementParameter(Element=element_18, Parameter="Id")  # -> Element, Value
element_parameter_6 = ElementParameter(Element=cluster_5.list_2, Parameter="Id")  # -> Element, Value
equality_4 = Equality(FirstNumber=element_parameter_5.Value, SecondNumber=element_parameter_6.Value)  # -> Equality, Inequality
cull_pattern_17 = CullPattern(List=element_parameter_6.Element, CullPattern=equality_4.Inequality)  # -> simplify(List)
cull_pattern_18 = CullPattern(List=cluster_5.list_3, CullPattern=equality_4.Inequality)  # -> simplify(List)

# ----
element_bounding_geometry = ElementBoundingGeometry(Element=element_parameter_5.Element)
element_19 = Element(cull_pattern_17)
deconstruct_brep = DeconstructBrep(Brep=element_bounding_geometry)  # -> Faces, Edges, Vertices
area_4 = Area(Geometry=deconstruct_brep.Faces)  # -> Area, Centroid
sort_list = SortList(Keys=area_4.Area, ValuesFaces=deconstruct_brep.Faces, ValuesCentroid=area_4.Centroid)  # -> Keys, ValuesFaces, ValuesCentroid
split_list = SplitList(List=sort_list.ValuesFaces, Index="4")  # -> ListA, ListB
split_list_2 = SplitList(List=sort_list.ValuesCentroid, Index="4")  # -> ListA, ListB
distance = Distance(PointA=point_7, PointB=split_list_2.ListB)
sort_list_2 = SortList(Distance=distance, ValuesFaces=split_list.ListB)  # -> Distance, ValuesFaces
list_item = ListItem(List=sort_list_2.ValuesFaces, Index=0, Wrap=True)  # -> Item, Item1
mesh_5 = Mesh(cull_pattern_18)
mesh_6 = Mesh(simplify(list_item.Item1))
collision_one_many = CollisionOneMany(Collider=mesh_6, Obstacles=mesh_5)  # -> Collision, Index
list_item_2 = ListItem(List=mesh_5, Index=collision_one_many.Index, Wrap=True)
list_item_3 = ListItem(List=element_19, Index=collision_one_many.Index, Wrap=True)
element_type = ElementType(Element=list_item_3)  # -> Element, Type
element_parameter_7 = ElementParameter(Element=element_type.Type, Parameter="Width")  # -> Element, Value

# ---- group: Thickness Outer Wall
data_9 = Data(element_parameter_7.Value)

# ---- group: Extend sill to a second wall if given / Thickness Outer Wall
data_10 = Data(flatten(data_9))

# ----
# WINDOWS
plane_normal = PlaneNormal(Origin=point_5, ZAxis=vector)  # -> simplify(graft(Plane))

# ---- group: Window Center
point_13 = Point(flatten(plane_normal))

# ----
# Prefiltering by neglecting Z-Dimension
deconstruct_brep_2 = DeconstructBrep(Brep=element_geometry_6)  # -> Faces, Edges, Vertices
evaluate_surface = EvaluateSurface(Surface=deconstruct_brep_2.Faces, Point="0.5,0.5")  # -> Point, Normal, UDirection, VDirection, Frame
unit_z_2 = UnitZ(Factor=1)
dot_product = DotProduct(VectorA=unit_z_2, VectorB=evaluate_surface.Normal, Unitize=False)
equality_5 = Equality(FirstNumber=dot_product, SecondNumber="-1")  # -> Equality, Inequality
cull_pattern_19 = CullPattern(List=deconstruct_brep_2.Faces, CullPattern=equality_5.Equality)  # -> flatten(List)
project = Project(Geometry=cull_pattern_19, Plane=PlaneXY(0, 0, 0))  # -> Geometry, Transform

# ----
# Floors
detail_level_3 = DetailLevel({"Coarse": 1, "Medium": 2, "Fine": 3}, selected="Coarse")
element_geometry_7 = ElementGeometry(Elements=cull_pattern_8, DetailLevel=detail_level_3)  # -> flatten(Geometry)
settings_speed_2 = SettingsSpeed()

# ---- group: Determine the floor area of the slabs
deconstruct_brep_3 = DeconstructBrep(Brep=element_geometry_7)  # -> Faces, Edges, Vertices
unit_z_3 = UnitZ(Factor=1)
evaluate_surface_2 = EvaluateSurface(Surface=deconstruct_brep_3.Faces, Point="0.5,0.5")  # -> Point, Normal, UDirection, VDirection, Frame
negative = Negative(Value=unit_z_3)
dot_product_2 = DotProduct(VectorA=evaluate_surface_2.Normal, VectorB=negative, Unitize=False)
equality_6 = Equality(FirstNumber=dot_product_2, SecondNumber="1")  # -> Equality, Inequality
cull_pattern_20 = CullPattern(List=deconstruct_brep_3.Faces, CullPattern=equality_6.Equality)  # -> simplify(List)

# ----
# Identify Glass and calculate Ratio
brep_18 = Brep(simplify(brep_5))
bounding_box_2 = BoundingBox(Content=brep_18, Plane=plane_normal)  # -> simplify(Box), Box_2
deconstruct_brep_4 = DeconstructBrep(Brep=bounding_box_2.Box)  # -> Faces, Edges, Vertices
evaluate_surface_3 = EvaluateSurface(Surface=reparameterize(deconstruct_brep_4.Faces), Point=construct_point)  # -> Point, Normal, UDirection, VDirection, Frame
trim_tree = TrimTree(Tree=evaluate_surface_3.Normal, Depth=1)
list_length_3 = ListLength(List=evaluate_surface_3.Normal)
angle_3 = Angle(VectorA=trim_tree, VectorB=plane_normal)  # -> Angle, Reflex
trim_tree_2 = TrimTree(Tree=list_length_3, Depth=1)
degrees_3 = Degrees(Radians=angle_3.Angle)
round = Round(Number=degrees_3)  # -> Nearest, Floor, Ceiling
expression_6 = Expression(x=round.Nearest, Expression="x = 180")
expression_7 = Expression(x=round.Nearest, Expression="x = 0")
gate_or_3 = GateOr(A=expression_7, B=expression_6)
partition_list_3 = PartitionList(List=gate_or_3, Size=trim_tree_2)

# ---- group: All Faces with Normal 0° or 180° to Window
cull_pattern_21 = CullPattern(List=deconstruct_brep_4.Faces, CullPattern=partition_list_3)

# ----
area_5 = Area(Geometry=cull_pattern_21)  # -> Area, Centroid
list_item_4 = ListItem(List=area_5.Centroid, Index=0, Wrap=True)  # -> Item, Item1
distance_2 = Distance(PointA=list_item_4.Item, PointB=list_item_4.Item1)
trim_tree_3 = TrimTree(Tree=area_5.Area, Depth=1)
trim_tree_4 = TrimTree(Tree=distance_2, Depth=1)
bounds_3 = Bounds(Numbers=trim_tree_3)
cull_nth = CullNth(List=trim_tree_3, CullFrequency=2)
bounds_4 = Bounds(Numbers=trim_tree_4)
deconstruct_domain_3 = DeconstructDomain(Domain=bounds_3)  # -> Start, End
deconstruct_domain_4 = DeconstructDomain(Domain=bounds_4)  # -> Start, End
equality_within_tolerance = EqualityWithinTolerance(FirstNumber=trim_tree_4, SecondNumber=deconstruct_domain_4.Start, Tolerance=0.1595272236)  # -> Equality, Inequality

# ---- group: GlassArea
cull_pattern_22 = CullPattern(List=cull_nth, CullPattern=equality_within_tolerance.Equality)

mass_addition_4 = MassAddition(Input=cull_pattern_22)  # -> simplify(Result), PartialResults

# ---- group: GlassElements
cull_pattern_23 = CullPattern(List=brep_18, CullPattern=equality_within_tolerance.Equality)  # disabled

# ---- group: FrameArea (filled) / Opening
number_25 = Number(deconstruct_domain_3.End)

# ---- group: Frame Area (only Frame)
subtraction_2 = Subtraction(A=number_25, B=mass_addition_4.Result)

# ----
division = Division(A=subtraction_2, B=number_25)  # -> flatten(Result)

# ---- group: Frame Ratio
number_26 = Number(flatten(division))

number_27 = Number(number_26)

# ----
# Various Window Data
bounding_box_3 = BoundingBox(Content=brep_6, Plane=plane_normal, UnionBox=True)  # -> Box, Box_2
cluster_6 = Cluster_3(brep=bounding_box_3.Box)  # -> vertical, bottom, top
area_6 = Area(Geometry=cluster_6.vertical)  # -> Area, Centroid
volume = Volume(Geometry=brep_8)  # -> Volume, Centroid
sort_list_3 = SortList(Keys=area_6.Area, ValuesCentroids=area_6.Centroid, ValuesFaces=cluster_6.vertical)  # -> Keys, ValuesCentroids, ValuesFaces
cluster_7 = Cluster_4(roombrep=brep_8, list=sort_list_3.ValuesCentroids, list_2=sort_list_3.ValuesFaces)  # -> window_outside_face, normal

# ---- group: Bottom of Window BBox
brep_19 = Brep(flatten(cluster_6.bottom))

# ---- group: Top of Window BBox
brep_20 = Brep(flatten(cluster_6.top))

# ---- group: Sill Window
brep_21 = Brep(simplify(brep_19))

# ----
# Expand Sill to Room
project_2 = Project(Geometry=brep_7, Plane=brep_21)  # -> Geometry, Transform
deconstruct_brep_5 = DeconstructBrep(Brep=brep_21)  # -> Faces, Edges, Vertices
deconstruct_brep_6 = DeconstructBrep(Brep=project_2.Geometry)  # -> Faces, Edges, Vertices
join_curves = JoinCurves(Curves=deconstruct_brep_6.Edges, Preserve=False)
pull_point = PullPoint(Point=deconstruct_brep_5.Vertices, Geometry=join_curves, ClosestOnly=True)  # -> ClosestPoint, Distance, Index
sort_list_4 = SortList(Distance=pull_point.Distance, ValuesVertices=deconstruct_brep_5.Vertices)  # -> Distance, ValuesVertices; disabled
sort_list_5 = SortList(Distance=pull_point.Distance, ValuesVertices=pull_point.ClosestPoint)  # -> Distance, ValuesVertices
list_item_5 = ListItem(List=sort_list_4.ValuesVertices, Index=0, Wrap=True)  # -> Item2, Item1, Item; disabled
list_item_6 = ListItem(List=sort_list_5.ValuesVertices, Index=0, Wrap=True)  # -> Item, Item1
point_14 = Point(simplify(list_item_6.Item))
point_15 = Point(simplify(list_item_6.Item1))
point_16 = Point(list_item_5.Item1)  # disabled

# ---- group: Window Heigth
area_7 = Area(Geometry=brep_20)  # -> Area, Centroid
area_8 = Area(Geometry=brep_19)  # -> Area, Centroid
deconstruct_9 = Deconstruct(Point=area_7.Centroid)  # -> XComponent, YComponent, ZComponent
deconstruct_10 = Deconstruct(Point=area_8.Centroid)  # -> XComponent, YComponent, ZComponent
subtraction_3 = Subtraction(A=deconstruct_9.ZComponent, B=deconstruct_10.ZComponent)

# ----
subtraction_4 = Subtraction(A=deconstruct_10.ZComponent, B=number_13)

element_type_2 = ElementType(Element=element_9)  # -> Element, Type
element_parameter_8 = ElementParameter(Element=element_type_2.Type, Parameter="Width")  # -> Element, Value
amplitude_2 = Amplitude(Vector=vector_3, Amplitude=element_parameter_8.Value)  # -> graft(Vector)
move_2 = Move(Geometry=point_15, Motion=amplitude_2)  # -> Geometry, Transform
move_3 = Move(Geometry=point_14, Motion=amplitude_2)  # -> Geometry, Transform

round_2 = Round(Number=subtraction_4)  # -> Nearest, Floor, Ceiling

# ---- group: Centroid of Window BBox (outside face)
point_17 = Point(flatten(cluster_7.window_outside_face))

# ---- group: Normal of Window BBox (outside face)
vector_13 = Vector(flatten(cluster_7.normal))

# ---- group: Window Normal
vector_14 = Vector(flatten(vector_13))

# ----
line_sdl_2 = LineSDL(Start=point_13, Direction=vector_14, Length=number_2)
rotate = Rotate(Geometry=line_sdl_2, Angle=graft(degrees(number_3)), Plane=point_13)  # -> Geometry, Transform
flip_matrix = FlipMatrix(Data=rotate.Geometry)
end_points_2 = EndPoints(Curve=flip_matrix)  # -> Start, End
list_item_7 = ListItem(List=end_points_2.End, Index=0, Wrap=True)  # -> Item, Item1
line = Line(StartPoint=list_item_7.Item, EndPoint=list_item_7.Item1)
join_curves_2 = JoinCurves(Curves=[line, flip_matrix], Preserve=False)  # -> flatten(Curves)
project_3 = Project(Geometry=join_curves_2, Plane=PlaneXY(0, 0, 0))  # -> Geometry, Transform
boundary_surfaces = BoundarySurfaces(Edges=project_3.Geometry)
mesh_mesh = MeshMesh(MeshA=graft(project.Geometry), MeshB=boundary_surfaces)
trim_tree_5 = TrimTree(Tree=mesh_mesh, Depth=1)  # -> simplify(Tree)
list_length_4 = ListLength(List=trim_tree_5)
larger_than_5 = LargerThan(FirstNumber=list_length_4, SecondNumber="0")  # -> flatten(LargerThan), OrEqualTo

# ---- group: Window_Normal
vector_15 = Vector(vector_13)

# ----
cull_pattern_24 = CullPattern(List=element_geometry_6, CullPattern=larger_than_5.LargerThan)
cull_pattern_25 = CullPattern(List=query_elements_4.Elements, CullPattern=larger_than_5.LargerThan)

# ---- group: SillHeigth
number_28 = Number(flatten(round_2.Nearest))

# ---- group: WindowHeigth
number_29 = Number(flatten(subtraction_3))

# ----
stream_gate_4 = StreamGate(Stream=move_2.Geometry, Gate=data_5)  # -> Target0, Target1

# ---- group: Centroid Window BBox
point_18 = Point(point_17)

# ---- group: Window Normal
vector_16 = Vector(vector_13)

# ---- group: Sill Heigth
number_30 = Number(number_28)

# ---- group: Window Heigth
number_31 = Number(number_29)

# ---- group: Window vectors
vector_17 = Vector(simplify(graft(vector_13)))

# ---- group: MESH Surroundings
mesh_7 = Mesh(cull_pattern_24)

# ---- group: Window Facing Vector
vector_18 = Vector(vector_13)

# ----
# BBox in front of windows
amplitude_3 = Amplitude(Vector=vector_15, Amplitude=number_8)

# ---- group: Check which floor slabs are located near the windows (Considerd as a 2D problem)
project_4 = Project(Geometry=cull_pattern_20, Plane=PlaneXY(0, 0, 0))  # -> Geometry, Transform

# ---- group: Check which floor slabs are located near the windows (Considerd as a 2D problem) / joining, if two actually separated objects were modeled as one object
mesh_join = MeshJoin(Meshes=project_4.Geometry)  # -> flatten(Mesh)

# ---- group: Handling by one or more windows per room
equality_7 = Equality(FirstNumber=number_9, SecondNumber="1")  # -> Equality, Inequality

# ----
# Generate Sill Faces
# Expand Sill Outer Wall
point_19 = Point(list_item_5.Item2)  # disabled
stream_gate_5 = StreamGate(Stream=move_3.Geometry, Gate=data_5)  # -> Target0, Target1

# ---- group: Extend sill to a second wall if given
# Expand Sill to 2nd Outer Wall
amplitude_4 = Amplitude(Vector=vector_4, Amplitude=data_10)
move_4 = Move(Geometry=stream_gate_4.Target0, Motion=graft(amplitude_4))  # -> Geometry, Transform
move_5 = Move(Geometry=stream_gate_5.Target0, Motion=graft(amplitude_4))  # -> Geometry, Transform

# ----
point_20 = Point([stream_gate_5.Target1, move_5.Geometry])
rectangle_3pt = Rectangle3Pt(PointA=point_14, PointB=point_15, PointC=point_20)  # -> Rectangle, Length
boundary_surfaces_2 = BoundarySurfaces(Edges=rectangle_3pt.Rectangle)  # -> flatten(Surfaces)

# ---- group: Window_Outside1
point_21 = Point(flatten(point_20))

# ----
point_22 = Point([move_4.Geometry, stream_gate_4.Target1])

# ---- group: Window_Outside2
point_23 = Point(flatten(point_22))

# ----
line_2 = Line(StartPoint=point_21, EndPoint=point_23)
extend_curve = ExtendCurve(Curve=line_2, Type=0, Start=number_8, End=number_8)
move_6 = Move(Geometry=extend_curve, Motion=amplitude_3)  # -> Geometry, Transform
entwine = Entwine(Branch00=extend_curve, Branch01=move_6.Geometry, FlattenInputs=True)
flip_matrix_2 = FlipMatrix(Data=entwine)
loft = Loft(Curves=flip_matrix_2, Options={Adjust=False, Closed=False, LoftEnds=0, LoftSimp=0, LoftType=0, Rebuild=10, Refit=0.01})

# ---- group: Check which floor slabs are located near the windows (Considerd as a 2D problem) (continued)
project_5 = Project(Geometry=loft, Plane=PlaneXY(0, 0, 0))  # -> Geometry, Transform
mesh_8 = Mesh(project_5.Geometry)
mesh_mesh_2 = MeshMesh(MeshA=mesh_8, MeshB=mesh_join)  # -> simplify(Intersections)

# ---- group: Handling by one or more windows per room (continued)
stream_gate_6 = StreamGate(Stream=mesh_mesh_2, Gate=equality_7.Equality)  # -> Target0, Target1
path_mapper = PathMapper(stream_gate_6.Target0, source="{a;b}", target="{b}")
list_length_5 = ListLength(List=[path_mapper, stream_gate_6.Target1])  # -> flatten(Length)

# ----
larger_than_6 = LargerThan(FirstNumber=list_length_5, SecondNumber="0")  # -> LargerThan, OrEqualTo
cull_pattern_26 = CullPattern(List=flatten(element_geometry_7), CullPattern=flatten(larger_than_6.LargerThan))
cull_pattern_27 = CullPattern(List=flatten(cull_pattern_8), CullPattern=flatten(larger_than_6.LargerThan))
mesh_brep_2 = MeshBrep(Brep=cull_pattern_26, Settings=settings_speed_2)

# ---- group: MESH - Slabs near to given Windows
mesh_9 = Mesh(mesh_brep_2)

# ---- group: RevitElement- Slabs near to given Windows
element_20 = Element(cull_pattern_27)

# ----
# Project Centerpoint to Facade Outside
unit_z_4 = UnitZ(Factor=1)
move_7 = Move(Geometry=point_22, Motion=unit_z_4)  # -> Geometry, Transform
plane_3pt = Plane3Pt(PointA=point_20, PointB=point_22, PointC=move_7.Geometry)
project_6 = Project(Geometry=point_18, Plane=flatten(plane_3pt))  # -> Geometry, Transform

# ---- group: Sill Breps
brep_22 = Brep(boundary_surfaces_2)

# ---- group: Move the measuring point in front of the façade (necessary if the geometry is determined using BBOXes)
amplitude_5 = Amplitude(Vector=vector_13, Amplitude=Slider(10, range=0..10))
move_8 = Move(Geometry=project_6.Geometry, Motion=amplitude_5)  # -> Geometry, Transform

# ---- group: CenterPoint Window (on outside Facade)
point_24 = Point(move_8.Geometry)

# ---- group: Center Point Window
point_25 = Point(point_24)

# ---- group: Sill Breps
brep_23 = Brep(brep_22)

# ---- group: Floors
mesh_10 = Mesh(mesh_9)

# ----
# Encode Windows
cluster_8 = Cluster_5(
    translation_vector=vector_6,
    G=brep_23,
    point=point_25,
    vector=vector_16,
    input=brep_11,
    heightsilloverfloor=number_30,
    frameratio=number_27,
    windowheight=number_31)  # -> encodedwindow, windowsillmesh_2, orientation, C
previewroom = CustomPreview(Geometry=cluster_8.windowsillmesh_2, Material=cluster_8.C)  # disabled

# ---- group: Window CenterPoints
point_26 = Point(point_24)

# ----
# Encode Room
subtraction_5 = Subtraction(A=number_16, B=number_15)
subtraction_6 = Subtraction(A=number_18, B=number_19)
repeat_data = RepeatData(Data=number_20, Length=number_17)
repeat_data_2 = RepeatData(Data=data_6, Length=number_17)
repeat_data_3 = RepeatData(Data=subtraction_6, Length=number_17)
repeat_data_4 = RepeatData(Data=subtraction_5, Length=number_17)
cluster_9 = Cluster_2(
    encodingareas=brep_15,
    heightroofoverfloor=repeat_data_3,
    heightflooroverterrain=repeat_data_4,
    heightceilingoverfloor=repeat_data,
    maxceilingoverfloorheight=repeat_data_2,
    translation_vector=vector_5,
    floor=brep_12,
    point=point_26,
    vector=vector_18)  # -> scaled_gdi_shape, C, S, orientedroomfloor, transformation_matrix, mesh_2, roomedges, roomxdimension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
previewroom_2 = CustomPreview(Geometry=cluster_9.mesh_2, Material=cluster_9.C)  # disabled

# ---- group: Window Points
point_27 = Point(simplify(graft(point_24)))

# ----
# Encode Context
panel_6 = Panel("1000")  # disabled
pixelsforcontextbar = Brep([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])  # disabled
scale_2 = Scale(Geometry=pixelsforcontextbar, Center=Point(0, 0, 0), Factor=panel_6)  # -> Geometry, Transform; disabled
repeat_data_5 = RepeatData(Data=graft(brep_10), Length=number_14)
flip_matrix_3 = FlipMatrix(Data=repeat_data_5)  # -> simplify(Data)
mesh_11 = Mesh(flatten([mesh_7, mesh_4]))
move_9 = Move(Geometry=flip_matrix_3, Motion=vector_7)  # -> Geometry, Transform
cluster_10 = Cluster_6(
    window_vector=vector_17,
    window_point=point_27,
    floor=brep_13,
    meshes=mesh_11,
    roofs=mesh_3,
    floors=mesh_10,
    contextpixelsascrv=move_9.Geometry)  # -> R, R_2, C, S
contextbargeo = Mesh(move_9.Geometry)  # disabled
previewcodedcntxt = CustomPreview(Geometry=contextbargeo, Material=cluster_10.C)  # disabled

# ----
# The drawing sequence of the shapes is determined by the sequence in the merge node. Lower inputs are displayed first (Exp: D4 over D3 over D2 over D1)
merge_3 = Merge(Data1=flatten(cluster_8.encodedwindow), Data2=flatten(cluster_9.S), Data3=flatten(cluster_10.S))

# ----
# Break if context bar couldnt be created correctly
null_item = NullItem(Item=cluster_10.S)  # -> NullFlags, InvalidFlags, Description
mass_addition_5 = MassAddition(Input=flatten(null_item.NullFlags))  # -> Result, PartialResults
larger_than_7 = LargerThan(FirstNumber=mass_addition_5.Result, SecondNumber="1")  # -> LargerThan, OrEqualTo
stream_gate_7 = StreamGate(Stream=merge_3, Gate=larger_than_7.OrEqualTo)  # -> Target0, Target1

# ----
# generate encoded image DF
clean_tree = CleanTree(RemoveNulls=True, RemoveInvalid=True, RemoveEmpty=False, Tree=stream_gate_7.Target0)
factor_for_1024x1024 = Slider(0.08, range=0..0.1)
colour_hsv = ColourHSV(Alpha="0.6", Hue="0", Saturation="0", Value="100")
draw = DrawImage(
    Shapes=clean_tree,
    Size=move.Geometry,
    Factor=factor_for_1024x1024,
    Background=colour_hsv,
    AntiAlias=False,
    FileLocation=text_3)

# ---- group: Room Edges
curve = Curve(cluster_9.roomedges)  # disabled

# ---- group: Transformations from OriginalPos. to PhotoFrame
transform = Transform(cluster_8.orientation)  # disabled

# ----
# determine if floorplans
# are out of bounds and selects the
# basis floorplan
brep_24 = Brep(move.Geometry)  # disabled
list_length_6 = ListLength(List=curve)  # -> flatten(Length); disabled
end_points_3 = EndPoints(Curve=curve)  # -> Start, End; disabled
point_28 = Point(simplify(end_points_3.Start))  # disabled
list_item_8 = ListItem(List=list_length_6, Index=0, Wrap=True)  # disabled
project_7 = Project(Geometry=point_28, Plane=brep_24)  # -> Geometry, Transform; disabled
surface_closest_point = SurfaceClosestPoint(Point=project_7.Geometry, Surface=brep_24)  # -> Point, UVPoint, Distance; disabled
panel_7 = Panel("0")  # disabled
equality_within_tolerance_2 = EqualityWithinTolerance(FirstNumber=surface_closest_point.Distance, SecondNumber=panel_7, Tolerance=0.1595272236)  # -> Equality, Inequality; disabled
# PREPARE REQUEST FOR SERVER
mass_addition_6 = MassAddition(Input=equality_within_tolerance_2.Equality)  # -> Result, PartialResults; disabled
equality_8 = Equality(FirstNumber=mass_addition_6.Result, SecondNumber=list_item_8)  # -> flatten(Equality), Inequality; disabled
python_3_script_2 = Python3Script(image_flags=equality_8.Equality)  # -> out, selected_index; inputs image_flags: list of Boolean; disabled
# ---------- python_3_script_2: Python ----------
if True in image_flags:
    selected_index = image_flags.index(1)
else:
    selected_index = 0
# ---------- end python_3_script_2 ----------

# ----
# determine distance from origin (upper left corner)
# to the nearest x,y coordinate of the floorarea
point_29 = Point(Point(6400, 11564.26604, -500))  # disabled
vector_19 = Vector(vector_5)  # disabled
move_10 = Move(Geometry=point_29, Motion=vector_19)  # -> graft(Geometry), Transform; disabled
point_30 = Point(project_7.Geometry)  # disabled
vector_2pt_3 = Vector2Pt(PointA=point_30, PointB=move_10.Geometry, Unitize=False)  # -> Vector, Length; disabled
deconstruct_vector_3 = DeconstructVector(Vector=vector_2pt_3.Vector)  # -> XComponent, YComponent, ZComponent; disabled
bounds_5 = Bounds(Numbers=deconstruct_vector_3.YComponent)  # disabled
bounds_6 = Bounds(Numbers=deconstruct_vector_3.XComponent)  # disabled
deconstruct_domain_5 = DeconstructDomain(Domain=bounds_6)  # -> flatten(Start), End; disabled
deconstruct_domain_6 = DeconstructDomain(Domain=bounds_5)  # -> flatten(Start), End; disabled

# ---- group: Index of Floorplan in Bounds
data_11 = Data(python_3_script_2.selected_index)  # disabled

# ---- group: Index of choosen Embeding
data_12 = Data(python_3_script_2.selected_index)  # disabled

# ---- group: GDI Shapes of Floorplan
data_13 = Data(cluster_9.scaled_gdi_shape)  # disabled

# ---- group: Index of Floorplan in Bounds
data_14 = Data(python_3_script_2.selected_index)  # disabled

# ---- group: Y
list_item_9 = ListItem(List=deconstruct_domain_5.Start, Index=data_12, Wrap=True)  # disabled

# ---- group: X
list_item_10 = ListItem(List=deconstruct_domain_6.Start, Index=data_12, Wrap=True)  # disabled

# ----
# mask to
# input result
list_item_11 = ListItem(List=flatten(brep_16), Index=data_14, Wrap=True)  # disabled
list_item_12 = ListItem(List=data_13, Index=data_14, Wrap=True)  # disabled
panel_8 = Panel("\mask.png")  # disabled
factor_for_128x128 = Slider(0.01, range=0..1)  # disabled
concatenate_2 = Concatenate(FragmentA=text_4, FragmentB=panel_8)  # disabled
color = ColourSwatch(SwatchColor=RGB(255, 255, 255))  # disabled
draw_2 = DrawImage(
    Shapes=list_item_12,
    Size=list_item_11,
    Factor=factor_for_128x128,
    Background=color,
    AntiAlias=False,
    FileLocation=concatenate_2)  # disabled

round_to_decimal_place = RoundToDecimalPlace(NumberX=list_item_9, DecimalPlace=panel_5, RoundType=0)  # -> Rounded, Difference; disabled
round_to_decimal_place_2 = RoundToDecimalPlace(NumberX=list_item_10, DecimalPlace=panel_5, RoundType=0)  # -> Rounded, Difference; disabled

# ---- group: Index of Floorplan in Bounds
data_15 = Data(python_3_script_2.selected_index)

# ----
# preparing for flask
panel_9 = Panel("1")  # disabled
equality_9 = Equality(FirstNumber=integer, SecondNumber=panel_9)  # -> Equality, Inequality; disabled
invert_matrix = InvertMatrix(Matrix=transform, Tolerance=0)  # -> Matrix, Success; disabled
deconstruct_matrix = DeconstructMatrix(Matrix=invert_matrix.Matrix)  # -> Rows, Columns, simplify(Values); disabled
panel_10 = Panel("""0
4""")  # disabled
list_item_13 = ListItem(List=deconstruct_matrix.Values, Index=panel_10, Wrap=True)  # -> Item, Item1; disabled
expression_8 = Expression(x=list_item_13.Item1, y=list_item_13.Item, Expression="Atan2(x,y)")  # disabled
tree_branch = TreeBranch(Tree=expression_8, Path=data_11, MaintainPaths=True)  # disabled
list_item_14 = ListItem(List=expression_8, Index=0, Wrap=True)  # disabled
list_item_15 = ListItem(List=tree_branch, Index=0, Wrap=True)  # disabled
subtraction_7 = Subtraction(A=list_item_15, B=list_item_14)  # -> flatten(Result); disabled
text_6 = Text(text)  # disabled

# ---- group: send rotation of 0 when there is only one picture
panel_11 = Panel("0")  # disabled
stream_filter = StreamFilter(Gate=equality_9.Equality, Stream0=subtraction_7, Stream1=panel_11)  # disabled

# ----
round_to_decimal_place_3 = RoundToDecimalPlace(NumberX=stream_filter, DecimalPlace=panel_5, RoundType=0)  # -> Rounded, Difference; disabled
python_3_script_3 = Python3Script(
    rotations_rad=round_to_decimal_place_3.Rounded,
    image_folder_path=text_6,
    num_images=number_21,
    x_value=round_to_decimal_place_2.Rounded,
    y_value=round_to_decimal_place.Rounded,
    executionMode=data_7,
    local_server_ip=text_5)  # -> out, a, success_output, output_image_path, average_value_output, ratio_gt1_output; inputs rotations_rad: list of Double, image_folder_path: String, num_images: Int32, x_value: Double, y_value: Double, executionMode: String, local_server_ip: String; disabled
# ---------- python_3_script_3: Python ----------
#r: requests, numpy

# GHPython inputs:
# image_folder_path : str
# rotations_rad     : list
# x_value, y_value  : float
# num_images        : int
# executionMode     : str  ("local" | "web")
# local_server_ip   : str
# trigger           : bool (optional)

import os, io, json, base64, requests, clr, System
import numpy as np
import Rhino.Geometry

# .NET bitmap tools
clr.AddReference("System.Drawing")
from System.Drawing import Bitmap, Imaging
import System.Runtime.InteropServices as RM

# Set server URL based on execution mode
LOCAL_SERVER_URL = local_server_ip
WEB_SERVER_URL   = "https://daylight-server-jia3y72oka-ma.a.run.app"
BASE_URL         = LOCAL_SERVER_URL if executionMode == "local" else WEB_SERVER_URL

# Grasshopper outputs
a                    = "Script not executed."
success_output       = False
output_image_path    = ""
average_value_output = None
ratio_gt1_output     = None

# Basic validation
if not os.path.isdir(image_folder_path):
    a = "Error: image_folder_path is invalid."
elif num_images < 0 or (num_images > 0 and len(rotations_rad) != num_images):
    a = "Error: rotation list length does not match num_images."
else:
    # Collect image files
    files_to_send = []
    for i in range(num_images):
        p = os.path.join(image_folder_path, "floorplan{}.png".format(i))
        if not os.path.exists(p):
            a = "Error: image not found – {}".format(p)
            break
        files_to_send.append(("file", (os.path.basename(p), open(p, "rb"), "image/png")))
    else:
        payload = {
            "rotation": json.dumps(list(rotations_rad)),
            "translation": json.dumps({"x": x_value, "y": y_value})
        }
        try:
            resp = requests.post("{}/get_df".format(BASE_URL), data=payload, files=files_to_send)
            
            if resp.status_code == 200:
                # Decode image from server response
                arr = np.load(io.BytesIO(base64.b64decode(resp.json()["content"])))
                h, w, channels = arr.shape

                # Logic to handle both RGB and RGBA (with alpha channel) images
                if channels == 4:
                    # Case 1: 4 channels (RGBA)
                    pixel_format = Imaging.PixelFormat.Format32bppArgb
                    # Convert RGBA (from numpy) to BGRA (for .NET Bitmap)
                    pixel_data = arr[:, :, [2, 1, 0, 3]].copy(order='C')
                elif channels == 3:
                    # Case 2: 3 channels (RGB)
                    pixel_format = Imaging.PixelFormat.Format24bppRgb
                    # Convert RGB (from numpy) to BGR (for .NET Bitmap)
                    pixel_data = arr[:, :, ::-1].copy(order='C')
                else:
                    raise ValueError("Unsupported number of image channels: {}".format(channels))

                # Create .NET Bitmap and copy pixel data
                bmp = Bitmap(w, h, pixel_format)
                rect = System.Drawing.Rectangle(0, 0, w, h)
                bmpData = bmp.LockBits(rect, Imaging.ImageLockMode.WriteOnly, bmp.PixelFormat)
                
                buf = System.Array[System.Byte](pixel_data.flatten().tolist())
                RM.Marshal.Copy(buf, 0, bmpData.Scan0, buf.Length)
                bmp.UnlockBits(bmpData)

                # Save the final image
                output_image_path = os.path.join(image_folder_path, "final_processed_image.png")
                bmp.Save(output_image_path, Imaging.ImageFormat.Png)
                bmp.Dispose()
                
                # Request stats for the saved PNG
                with open(output_image_path, "rb") as fh:
                    stats_resp = requests.post("{}/get_stats".format(BASE_URL),
                                                 files=[("file", ("final_processed_image.png", fh, "image/png"))])

                if stats_resp.status_code == 200 and stats_resp.json().get("success", False):
                    metrics              = stats_resp.json()["metrics"]
                    average_value_output = float(metrics.get("average_value"))
                    ratio_gt1_output     = float(metrics.get("ratio_gt1"))
                    a                    = "Success: image processed and stats received."
                    success_output       = True
                else:
                    a = "Stats request failed ({}).".format(stats_resp.status_code)
            else:
                err = resp.text[:200]
                try: err = resp.json().get("error", err)
                except ValueError: pass
                a = "Server error {}: {}".format(resp.status_code, err)

        except (requests.exceptions.RequestException, ValueError) as e:
            a = "Error: {}".format(e)
        finally:
            for _, f_tuple in files_to_send:
                if f_tuple[1] and not f_tuple[1].closed:
                    f_tuple[1].close()
# ---------- end python_3_script_3 ----------

merge_4 = Merge(Data1=python_3_script_3.output_image_path, Data2=concatenate_2)  # -> flatten(Result); disabled
stream_gate_8 = StreamGate(Stream=merge_4, Gate=python_3_script_3.success_output)  # -> Target0, Target1; disabled

# ---- group: Average DF
data_16 = Data(python_3_script_3.average_value_output)  # disabled

# ---- group: Ratio over 1% DF
data_17 = Data(python_3_script_3.ratio_gt1_output)  # disabled

# ----
dispatch = Dispatch(List=stream_gate_8.Target1, DispatchPattern=[True, False])  # -> ListA, ListB

import_image = ImportImage(File=dispatch.ListA, Rectangle=brep_17, XSamples="128", YSamples="128")
import_image_2 = ImportImage(File=dispatch.ListB, Rectangle=brep_17, XSamples="128", YSamples="128")

# ---- group: Ratio over 1% DF
data_18 = Data(data_17)

# ----
# write values to room parameters
# and display in revit
area_9 = Area(Geometry=brep_4)  # -> Area, Centroid
division_2 = Division(A=area_9.Area, B="1000000")
multiplication_2 = Multiplication(A=division_2, B=data_18)
round_to_decimal_place_4 = RoundToDecimalPlace(NumberX=multiplication_2, DecimalPlace="2", RoundType=0)  # -> Rounded, Difference
unit_z_5 = UnitZ(Factor="1200")
concatenate_3 = Concatenate(FragmentA=round_to_decimal_place_4.Rounded, FragmentB="m²")
move_11 = Move(Geometry=area_9.Centroid, Motion=unit_z_5)  # -> Geometry, Transform
xy = XYPlane(Origin=move_11.Geometry)
negative_2 = Negative(Value=Slider(100, range=0..100))
unit_y = UnitY(Factor=negative_2)
python_3_script_4 = Python3Script()  # -> out, a
# ---------- python_3_script_4: Python ----------
import rhinoscriptsyntax as rs
import Rhino

dsc = Rhino.RhinoDoc.ActiveDoc.DimStyles.Count
a = [Rhino.RhinoDoc.ActiveDoc.DimStyles.FindIndex(i) for i in range(0,dsc)]
# ---------- end python_3_script_4 ----------
move_12 = Move(Geometry=xy, Motion=unit_y)  # -> Geometry, Transform
item = ListItem(List=python_3_script_4.a, Index=Slider(0, range=0..10), Wrap=True)
python_3_script_5 = Python3Script(pl=move_12.Geometry, ds=item, txt="≥ 1% DF")  # -> out, a
# ---------- python_3_script_5: Python ----------
import rhinoscriptsyntax as rs
import Rhino.Geometry as rg
import Rhino.DocObjects as rd
import Rhino


rg.Plane.WorldXY
rW = 10
rR = 0
oTxt = rg.TextEntity.Create(txt, pl, ds, False, rW, rR)
ds.TextHeight = 150
ds.TextHorizontalAlignment =  rd.TextHorizontalAlignment.Center
ds.TextVerticalAlignment = rd.TextVerticalAlignment.Top

a = rg.TextEntity.CreateCurves(oTxt, ds,False,1)
# ---------- end python_3_script_5 ----------
python_3_script_6 = Python3Script(pl=xy, ds=item, txt=concatenate_3)  # -> out, a
# ---------- python_3_script_6: Python ----------
import rhinoscriptsyntax as rs
import Rhino.Geometry as rg
import Rhino.DocObjects as rd
import Rhino


rg.Plane.WorldXY
rW = 10
rR = 0
oTxt = rg.TextEntity.Create(txt, pl, ds, False, rW, rR)
ds.TextHeight = 300
ds.TextHorizontalAlignment =  rd.TextHorizontalAlignment.Center
ds.TextVerticalAlignment = rd.TextVerticalAlignment.Bottom

a = rg.TextEntity.CreateCurves(oTxt, ds,False,1)
# ---------- end python_3_script_6 ----------
merge_5 = Merge(Data1=python_3_script_6.a, Data2=python_3_script_5.a)
convert_material = ConvertMaterial(Shader=ColourSwatch(SwatchColor=RGB(255, 255, 255)), TrackingMode=2)
boundary_surfaces_3 = BoundarySurfaces(Edges=merge_5)
add_directshape_geometry = AddDirectShapeGeometry(Geometry=flatten(boundary_surfaces_3), Material=convert_material, TrackingMode=2)
panel_12 = Panel(add_directshape_geometry)

mesh_12 = Mesh(import_image_2)
mesh_13 = Mesh(import_image)
mesh_explode = MeshExplode(Mesh=mesh_13, Interpolate=invert(False))
mesh_explode_2 = MeshExplode(Mesh=mesh_12, Interpolate=invert(False))

# ----
# Filter room geometry
deconstruct_mesh = DeconstructMesh(Mesh=mesh_explode_2)  # -> Vertices, Faces, Colours, Normals
deconstruct_face = DeconstructFace(Face=deconstruct_mesh.Faces)  # -> CornerA, CornerB, CornerC, CornerD
item_2 = ListItem(List=deconstruct_mesh.Colours, Index=deconstruct_face.CornerA, Wrap=True)
col = Colour(flatten(item_2))
# DRAW RESULT IN REVIT
rgb_values = Panel(col)
python_3_script_7 = Python3Script(data=rgb_values)  # -> out, sums; inputs data: list of String
# ---------- python_3_script_7: Python ----------
import rhinoscriptsyntax as rs

# Input: data (list of strings)
# Output: sums (list of sums)

def split_and_sum(data):
    if data is None:
        return [None]  # If the entire input data is None, return a list with None
    
    sums = []
    for item in data:
        if item is None:
            sums.append(None)
            continue
        
        item = item.strip()
        if item == "":
            sums.append(None)
            continue
        
        numbers = item.split(',')
        
        try:
            numbers = [float(num) for num in numbers]
            sums.append(sum(numbers))
        except ValueError:
            sums.append(None)
    return sums

# Call the function and assign to output
sums = split_and_sum(data)
# ---------- end python_3_script_7 ----------
multiplication_3 = Multiplication(A="255", B="3")
equality_10 = Equality(FirstNumber=python_3_script_7.sums, SecondNumber=multiplication_3)  # -> Equality, Inequality

dispatch_2 = Dispatch(List=mesh_explode, DispatchPattern=equality_10.Equality)  # -> ListA, ListB

# ----
# mark the elements
#  involved in the analysis
# write results to rooms
element_21 = Element(flatten(element_17))
element_22 = Element(flatten(cull_pattern_6))
element_23 = Element(flatten(cull_pattern))
element_24 = Element(flatten(element_20))
element_25 = Element(flatten(cull_pattern_25))
stream_gate_9 = StreamGate(Stream=element_21, Gate=data_8)  # -> Target0, Target1
stream_gate_10 = StreamGate(Stream=element_23, Gate=data_8)  # -> Target0, Target1
stream_gate_11 = StreamGate(Stream=element_22, Gate=data_8)  # -> Target0, Target1
stream_gate_12 = StreamGate(Stream=element_24, Gate=data_8)  # -> Target0, Target1
stream_gate_13 = StreamGate(Stream=element_25, Gate=data_8)  # -> Target0, Target1
stream_gate_14 = StreamGate(Stream=element_10, Gate=data_8)  # -> Target0, Target1
element_parameter_9 = ElementParameter(Element=stream_gate_14.Target1, Parameter="UPSKR_PASSING_DF_AREA", Value=round_to_decimal_place_4.Rounded)
element_parameter_10 = ElementParameter(Element=stream_gate_10.Target1, Parameter="UPSKR_DF", Value="SelectedWindow")  # -> Element, Value
element_parameter_11 = ElementParameter(Element=stream_gate_11.Target1, Parameter="UPSKR_DF", Value="SelectedRoof")  # -> Element, Value
element_parameter_12 = ElementParameter(Element=stream_gate_12.Target1, Parameter="UPSKR_DF", Value="SelectedRoof")  # -> Element, Value
element_parameter_13 = ElementParameter(Element=stream_gate_13.Target1, Parameter="UPSKR_DF", Value="SelectedSite")  # -> Element, Value
element_parameter_14 = ElementParameter(Element=stream_gate_9.Target1, Parameter="UPSKR_DF", Value="SelectedWall")  # -> Element, Value

# ---- group: Transformation Matrix
transform_2 = Transform(invert_matrix.Matrix)

# ----
# create geometry in revit
deconstruct_mesh_2 = DeconstructMesh(Mesh=dispatch_2.ListB)  # -> simplify(Vertices), simplify(Faces), simplify(Colours), Normals
list_item_16 = ListItem(List=deconstruct_mesh_2.Colours, Index=0, Wrap=True)  # -> flatten(Item)
list_item_17 = ListItem(List=transform_2, Index=data_15, Wrap=True)

python_3_script_8 = Python3Script(original_mesh_colors_input=list_item_16, Datatree1=deconstruct_mesh_2.Vertices)  # -> out, ResultTree_A, PaletteColors_B; inputs original_mesh_colors_input: list of Color, Datatree1: tree
# ---------- python_3_script_8: Python ----------
import math
import System  # Needed for System.Drawing.Color
from Grasshopper import DataTree
from Grasshopper.Kernel.Data import GH_Path

# # --- 1. PALETTE DEFINITION (Vom Benutzer einzufügen/anzupassen) ---
# # Kommentierte, längere Palette als Referenz
# palette_definition = [
#     {"Color": [0, 0, 255], "Value": 0}, {"Color": [11, 0, 244], "Value": 0.1},
#     {"Color": [21, 0, 234], "Value": 0.2}, {"Color": [32, 0, 223], "Value": 0.3},
#     {"Color": [42, 0, 213], "Value": 0.4}, {"Color": [53, 0, 202], "Value": 0.5},
#     {"Color": [64, 0, 191], "Value": 0.6}, {"Color": [75, 0, 180], "Value": 0.7},
#     {"Color": [85, 0, 170], "Value": 0.8}, {"Color": [96, 0, 159], "Value": 0.9},
#     {"Color": [107, 0, 148], "Value": 1}, {"Color": [118, 0, 137], "Value": 1.1},
#     {"Color": [128, 0, 127], "Value": 1.2}, {"Color": [139, 0, 116], "Value": 1.3},
#     {"Color": [149, 0, 106], "Value": 1.4}, {"Color": [160, 0, 95], "Value": 1.5},
#     {"Color": [171, 0, 84], "Value": 1.6}, {"Color": [182, 0, 73], "Value": 1.7},
#     {"Color": [192, 0, 63], "Value": 1.8}, {"Color": [203, 0, 52], "Value": 1.9},
#     {"Color": [214, 0, 41], "Value": 2}, {"Color": [222, 2, 33], "Value": 2.1},
#     {"Color": [230, 5, 25], "Value": 2.2}, {"Color": [239, 7, 16], "Value": 2.3},
#     {"Color": [247, 10, 8], "Value": 2.4}, {"Color": [255, 12, 0], "Value": 2.5},
#     {"Color": [255, 23, 0], "Value": 2.6}, {"Color": [255, 34, 0], "Value": 2.7},
#     {"Color": [255, 44, 0], "Value": 2.8}, {"Color": [255, 55, 0], "Value": 2.9},
#     {"Color": [255, 66, 0], "Value": 3}, {"Color": [255, 77, 0], "Value": 3.1},
#     {"Color": [255, 87, 0], "Value": 3.2}, {"Color": [255, 98, 0], "Value": 3.3},
#     {"Color": [255, 108, 0], "Value": 3.4}, {"Color": [255, 119, 0], "Value": 3.5},
#     {"Color": [255, 130, 0], "Value": 3.6}, {"Color": [255, 141, 0], "Value": 3.7},
#     {"Color": [255, 151, 0], "Value": 3.8}, {"Color": [255, 162, 0], "Value": 3.9},
#     {"Color": [255, 173, 0], "Value": 4}, {"Color": [255, 184, 0], "Value": 4.1},
#     {"Color": [255, 194, 0], "Value": 4.2}, {"Color": [255, 205, 0], "Value": 4.3},
#     {"Color": [255, 215, 0], "Value": 4.4}, {"Color": [255, 226, 0], "Value": 4.5},
#     {"Color": [255, 232, 0], "Value": 4.6}, {"Color": [255, 238, 0], "Value": 4.7},
#     {"Color": [255, 243, 0], "Value": 4.8}, {"Color": [255, 249, 0], "Value": 4.9},
#     {"Color": [255, 255, 0], "Value": 5}, {"Color": [255, 255, 5], "Value": 5.1},
#     {"Color": [255, 255, 10], "Value": 5.2}, {"Color": [255, 255, 15], "Value": 5.3},
#     {"Color": [255, 255, 20], "Value": 5.4}, {"Color": [255, 255, 25], "Value": 5.5},
#     {"Color": [255, 255, 30], "Value": 5.6}, {"Color": [255, 255, 35], "Value": 5.7},
#     {"Color": [255, 255, 40], "Value": 5.8}, {"Color": [255, 255, 45], "Value": 5.9},
#     {"Color": [255, 255, 50], "Value": 6}, {"Color": [255, 255, 55], "Value": 6.1},
#     {"Color": [255, 255, 60], "Value": 6.2}, {"Color": [255, 255, 65], "Value": 6.3},
#     {"Color": [255, 255, 70], "Value": 6.4}, {"Color": [255, 255, 75], "Value": 6.5},
#     {"Color": [255, 255, 80], "Value": 6.6}, {"Color": [255, 255, 85], "Value": 6.7},
#     {"Color": [255, 255, 90], "Value": 6.8}, {"Color": [255, 255, 95], "Value": 6.9},
#     {"Color": [255, 255, 100], "Value": 7}, {"Color": [255, 255, 105], "Value": 7.1},
#     {"Color": [255, 255, 110], "Value": 7.2}, {"Color": [255, 255, 115], "Value": 7.3},
#     {"Color": [255, 255, 120], "Value": 7.4}, {"Color": [255, 255, 125], "Value": 7.5},
#     {"Color": [255, 255, 130], "Value": 7.6}, {"Color": [255, 255, 135], "Value": 7.7},
#     {"Color": [255, 255, 140], "Value": 7.8}, {"Color": [255, 255, 145], "Value": 7.9},
#     {"Color": [255, 255, 150], "Value": 8}, {"Color": [255, 255, 155], "Value": 8.1},
#     {"Color": [255, 255, 160], "Value": 8.2}, {"Color": [255, 255, 165], "Value": 8.3},
#     {"Color": [255, 255, 170], "Value": 8.4}, {"Color": [255, 255, 175], "Value": 8.5},
#     {"Color": [255, 255, 180], "Value": 8.6}, {"Color": [255, 255, 185], "Value": 8.7},
#     {"Color": [255, 255, 190], "Value": 8.8}, {"Color": [255, 255, 195], "Value": 8.9},
#     {"Color": [255, 255, 200], "Value": 9}, {"Color": [255, 255, 205], "Value": 9.1},
#     {"Color": [255, 255, 210], "Value": 9.2}, {"Color": [255, 255, 215], "Value": 9.3},
#     {"Color": [255, 255, 220], "Value": 9.4}, {"Color": [255, 255, 225], "Value": 9.5},
#     {"Color": [255, 255, 230], "Value": 9.6}, {"Color": [255, 255, 235], "Value": 9.7},
#     {"Color": [255, 255, 240], "Value": 9.8}, {"Color": [255, 255, 245], "Value": 9.9},
#     {"Color": [255, 255, 250], "Value": 10}
# ]

palette_definition = [
    {"Color": [0, 0, 255], "Value": 0}, {"Color": [53, 0, 202], "Value": 0.5},
    {"Color": [107, 0, 148], "Value": 1}, {"Color": [160, 0, 95], "Value": 1.5},
    {"Color": [214, 0, 41], "Value": 2}, {"Color": [255, 12, 0], "Value": 2.5},
    {"Color": [255, 66, 0], "Value": 3}, {"Color": [255, 119, 0], "Value": 3.5},
    {"Color": [255, 173, 0], "Value": 4}, {"Color": [255, 226, 0], "Value": 4.5},
    {"Color": [255, 255, 0], "Value": 5}, {"Color": [255, 255, 25], "Value": 5.5},
    {"Color": [255, 255, 50], "Value": 6}, {"Color": [255, 255, 75], "Value": 6.5},
    {"Color": [255, 255, 100], "Value": 7}, {"Color": [255, 255, 125], "Value": 7.5},
    {"Color": [255, 255, 150], "Value": 8}, {"Color": [255, 255, 175], "Value": 8.5},
    {"Color": [255, 255, 200], "Value": 9}, {"Color": [255, 255, 225], "Value": 9.5},
    {"Color": [255, 255, 250], "Value": 10}
]


# -----------------------------------------------------------------------------
# Helper: convert palette RGB triplets into System.Drawing.Color once up‑front
# -----------------------------------------------------------------------------
palette_rgb_colors = [item["Color"] for item in palette_definition]
palette_system_colors = []
for item in palette_definition:
    try:
        r, g, b = item["Color"]
        palette_system_colors.append(System.Drawing.Color.FromArgb(int(r), int(g), int(b)))
    except Exception as e:
        # Fallback colour (magenta) marks an invalid palette entry
        print("Warning: Invalid palette colour {}. Error: {}".format(item["Color"], e))
        palette_system_colors.append(System.Drawing.Color.Magenta)


def calculate_squared_distance(color1_rgb, color2_rgb):
    """Return squared Euclidean distance between two RGB colours (faster than full sqrt)."""
    dr = float(color1_rgb[0]) - float(color2_rgb[0])
    dg = float(color1_rgb[1]) - float(color2_rgb[1])
    db = float(color1_rgb[2]) - float(color2_rgb[2])
    return dr * dr + dg * dg + db * db

# -----------------------------------------------------------------------------
# Output DataTrees initialisation – these map to component outputs (e.g. A, B)
# -----------------------------------------------------------------------------
script_output_A = DataTree[object]()        # Holds payload from Datatree1
script_output_B = DataTree[object]()        # Holds matched palette colours

# -----------------------------------------------------------------------------
# Validate primary inputs
# -----------------------------------------------------------------------------
if "Datatree1" not in globals() or Datatree1 is None:
    print("Datatree1 missing or undefined – outputs remain empty.")
    ResultTree_A = script_output_A
    PaletteColors_B = script_output_B
    if "original_mesh_colors_input" not in globals():
        original_mesh_colors_input = []  # Avoid failures later

# -----------------------------------------------------------------------------
# 1) Map every original mesh colour → closest palette entry
#    Creates a dict {palette_idx: [orig_colour_idx, …]}
# -----------------------------------------------------------------------------
mapped_indices_by_palette_idx = {}

if "original_mesh_colors_input" in globals() and original_mesh_colors_input:
    for original_idx, gh_color in enumerate(original_mesh_colors_input):
        if gh_color is None:
            continue  # Skip missing entries
        try:
            original_color_rgb = [gh_color.R, gh_color.G, gh_color.B]
        except AttributeError:
            continue  # Not a valid colour object

        min_sq_dist = float('inf')
        closest_palette_idx = -1

        for palette_idx, pal_rgb_color in enumerate(palette_rgb_colors):
            sq_dist = calculate_squared_distance(original_color_rgb, pal_rgb_color)
            if sq_dist < min_sq_dist:
                min_sq_dist = sq_dist
                closest_palette_idx = palette_idx
                if sq_dist == 0.0:
                    break  # Perfect match – stop early

        if closest_palette_idx != -1:
            mapped_indices_by_palette_idx.setdefault(closest_palette_idx, []).append(original_idx)

# -----------------------------------------------------------------------------
# 2) Build output trees
#    Path pattern: {palette_idx; sub_branch}
# -----------------------------------------------------------------------------
num_palette_entries = len(palette_system_colors)

for current_palette_idx in range(num_palette_entries):
    current_palette_color_obj = palette_system_colors[current_palette_idx]
    indices_referencing_dt1 = mapped_indices_by_palette_idx.get(current_palette_idx, [])

    if not indices_referencing_dt1:
        # Palette colour is unused → create empty branch {idx;0}
        empty_path = GH_Path([current_palette_idx, 0])
        script_output_A.EnsurePath(empty_path)
        script_output_B.EnsurePath(empty_path)
        continue

    # Palette colour is used at least once – iterate per matching original index
    for sub_branch_idx, dt1_branch_idx in enumerate(indices_referencing_dt1):
        path_out = GH_Path([current_palette_idx, sub_branch_idx])
        path_in = GH_Path(dt1_branch_idx)  # Assumes integer branch numbering in Datatree1

        if "Datatree1" in globals() and Datatree1 is not None and Datatree1.PathExists(path_in):
            items_from_dt1 = Datatree1.Branch(path_in)
            has_items = bool(items_from_dt1 and (len(items_from_dt1) if hasattr(items_from_dt1, "__len__") else items_from_dt1.Count))
            if has_items:
                script_output_A.AddRange(items_from_dt1, path_out)
                script_output_B.Add(current_palette_color_obj, path_out)
            else:
                # Branch exists but is empty – create matching empty branches in both outputs
                script_output_A.EnsurePath(path_out)
                script_output_B.EnsurePath(path_out)
        else:
            # Input branch missing – log info string in A, keep B empty
            info_message = "Info: D1 branch {{{}}} not found or D1 is None.".format(dt1_branch_idx)
            script_output_A.Add(info_message, path_out)
            script_output_B.EnsurePath(path_out)

# -----------------------------------------------------------------------------
# 3) Assign component outputs
# -----------------------------------------------------------------------------
ResultTree_A = script_output_A
PaletteColors_B = script_output_B
# ---------- end python_3_script_8 ----------

construct_mesh = ConstructMesh(Vertices=python_3_script_8.ResultTree_A, Faces="Q{0;1;2;3}")
trim_tree_6 = TrimTree(Tree=python_3_script_8.PaletteColors_B, Depth=1)
trim_tree_7 = TrimTree(Tree=construct_mesh, Depth=1)
list_item_18 = ListItem(List=trim_tree_6, Index=0, Wrap=True)
mesh_join_2 = MeshJoin(Meshes=trim_tree_7)
transform_3 = Transform(Geometry=mesh_join_2, Transform=list_item_17)
convert_material_2 = ConvertMaterial(Shader=list_item_18, TrackingMode=2)
add_directshape_geometry_2 = AddDirectShapeGeometry(Geometry=transform_3, Material=convert_material_2, TrackingMode=2)

# ==== cluster Cluster
brep = ClusterInput()
deconstruct_brep = DeconstructBrep(Brep=brep)  # -> Faces, Edges, Vertices
evaluate_surface = EvaluateSurface(Surface=deconstruct_brep.Faces, Point="0.5,0.5")  # -> Point, Normal, UDirection, VDirection, Frame
unit_z = UnitZ(Factor=1)
dot_product = DotProduct(VectorA=unit_z, VectorB=evaluate_surface.Normal, Unitize=False)
equality = Equality(FirstNumber=dot_product, SecondNumber="0")  # -> Equality, Inequality
equality_2 = Equality(FirstNumber=dot_product, SecondNumber="-1")  # -> Equality, Inequality
equality_3 = Equality(FirstNumber=dot_product, SecondNumber="1")  # -> Equality, Inequality

# ---- group: Wall
cull_pattern = CullPattern(List=deconstruct_brep.Faces, CullPattern=equality.Equality)

# ---- group: Bottom
cull_pattern_2 = CullPattern(List=deconstruct_brep.Faces, CullPattern=equality_2.Equality)

# ---- group: Top
cull_pattern_3 = CullPattern(List=deconstruct_brep.Faces, CullPattern=equality_3.Equality)

# ----
list = ClusterOutput(cull_pattern)
list_2 = ClusterOutput(cull_pattern_2)
list_3 = ClusterOutput(cull_pattern_3)

# ==== cluster Cluster_2
maxceilingoverfloorheight = ClusterInput()
floor = ClusterInput()
heightflooroverterrain = ClusterInput()
heightceilingoverfloor = ClusterInput()
heightroofoverfloor = ClusterInput()
floor_2 = Brep(floor)
maxceilingoverfloorheight_2 = Data(maxceilingoverfloorheight)
vector = ClusterInput()
point = ClusterInput()
encodingareas = ClusterInput()
orient = Orient(G_2=floor_2, O=point, x=vector, G=floor_2)  # -> G_3, transformation_matrix

# ---- group: Encoding Areas
brep = Brep(encodingareas)

# ----
bbox = BoundingBox(Content=orient.G_3, Plane=PlaneXY(0, 0, 0))  # -> Box, Box_2
panel = Panel(maxceilingoverfloorheight_2)
dom = ConstructDomain(DomainStart="0", DomainEnd="30000")
dom_2 = ConstructDomain(DomainStart="0", DomainEnd="1")
dom_3 = ConstructDomain(DomainStart="0", DomainEnd="10000")
dom_4 = ConstructDomain(DomainStart="0", DomainEnd="1")
dom_5 = ConstructDomain(DomainStart="0", DomainEnd=panel)
dom_6 = ConstructDomain(DomainStart="0", DomainEnd="1")
scale_factor_for_white_frame_and_avoid_t = Panel("0.93")  # "Scale Factor (for White Frame and avoid touching ContextBar)"
debox = DeconstructBox(Box=bbox.Box)  # -> Plane, X, Y, Z
explode = Explode(Curve=orient.G_3, Recursive=True)  # -> Segments, Vertices
remap = RemapNumbers(HeightRoofOverFloor=heightroofoverfloor, Source=dom, Target=dom_2)  # -> Mapped, Clipped
remap_2 = RemapNumbers(HeightFloorOverTerrain=heightflooroverterrain, Source=dom_3, Target=dom_4)  # -> Mapped, Clipped
remap_3 = RemapNumbers(HeightCeilingOverFloor=heightceilingoverfloor, Source=dom_5, Target=dom_6)  # -> Mapped, Clipped
curvepoint = PointOnCurve(explode.Segments, parameter=0.5)
dedomain = DeconstructDomain(Domain=debox.Y)  # -> Start, End
dedomain_2 = DeconstructDomain(Domain=debox.X)  # -> Start, End
pt = ConstructPoint(XCoordinate=dedomain_2.End, YCoordinate=dedomain.End, ZCoordinate=0)
pt_2 = ConstructPoint(XCoordinate=dedomain_2.Start, YCoordinate=dedomain.Start, ZCoordinate=0)
rec_2pt = Rectangle2Pt(Plane=PlaneXY(0, 0, 0), PointA=pt_2, PointB=pt, Radius=0)  # -> Rectangle, Length
area = Area(Geometry=rec_2pt.Rectangle)  # -> Area, Centroid
area_2 = Area(Geometry=orient.G_3)  # -> Area, Centroid
area_3 = Area(Geometry=brep)
subtraction = Subtraction(A=dedomain_2.End, B=dedomain_2.Start)
subtraction_2 = Subtraction(A=dedomain.End, B=dedomain.Start)
pdecon = Deconstruct(Point=curvepoint)  # -> XComponent, YComponent, ZComponent
transformation_matrix = ClusterOutput(orient.transformation_matrix)
orientedroomfloor = ClusterOutput(orient.G_3)
subtraction_3 = Subtraction(A=area.Area, B=area_2.Area)
scale = Scale(Geometry=brep, Center=area_3, Factor=scale_factor_for_white_frame_and_avoid_t)  # -> Geometry, Transform
hsv = ColourHSV(Alpha=1, Hue=remap.Clipped, Saturation=remap_2.Clipped, Value=remap_3.Clipped)
sort = SortList(Keys=pdecon.YComponent, ValuesA=explode.Segments)  # -> Keys, ValuesA
expression = Expression(x=subtraction_2, Expression="Round(x,2)")
expression_2 = Expression(x=subtraction, Expression="Round(x,2)")
division = Division(A=subtraction_3, B=area.Area)
C = ClusterOutput(hsv)
item = ListItem(List=sort.ValuesA, Index=0, Wrap=True)
multiplication = Multiplication(A=division, B=100)
curve = Curve(scale.Geometry)
len = Length(Curve=item)
expression_3 = Expression(x=area_2.Area, Expression="Round(x,2)")
expression_4 = Expression(x=multiplication, Expression="Round(x,2)")
roomydimension = ClusterOutput(expression)
roomxdimension = ClusterOutput(expression_2)
expression_5 = Expression(x=len, Expression="Round(x,2)")
ofroomrectaglecut = ClusterOutput(expression_4)
ofroomarea = ClusterOutput(expression_3)
windowwalllength = ClusterOutput(expression_5)
translation_vector = ClusterInput()
project = Project(Geometry=orient.G_3, Plane=PlaneXY(0, 0, 0))  # -> Geometry, Transform
move = Move(Geometry=project.Geometry, Motion=translation_vector)  # -> Geometry, Transform

# ---- group: Floor Areas
brep_2 = Brep(move.Geometry)

# ----
project_2 = Project(Geometry=brep_2, Plane=brep)  # -> Geometry, Transform
split_brep = SplitBrep(Brep=project_2.Geometry, Cutter=curve)  # -> simplify(Result)

# ---- group: Cut-to-size Floor Areas
brep_3 = Brep(split_brep)

# ----
list_length = ListLength(List=brep_3)
larger_than = LargerThan(FirstNumber=list_length, SecondNumber="1")  # -> LargerThan, OrEqualTo
dispatch = Dispatch(List=graft(scale.Geometry), DispatchPattern=larger_than.LargerThan)  # -> ListA, ListB
dispatch_2 = Dispatch(List=brep_3, DispatchPattern=larger_than.LargerThan)  # -> ListA, ListB

# ---- group: Floor Area
brep_4 = Brep(dispatch_2.ListA)

# ---- group: Encoding Area
# Beware: Not currently taken into account: The centroid of certain geometries may still lie within the encoding area.
brep_5 = Brep(dispatch.ListA)

# ---- group: When matching pure surfaces, the desired result was not achieved. It works with extrusion.
unit_z = UnitZ(Factor=1)
negative = Negative(Value=unit_z)
extrude = Extrude(Base=brep_5, Direction=unit_z)
extrude_2 = Extrude(Base=brep_5, Direction=negative)
solid_union = SolidUnion(Breps=[extrude, extrude_2])

# ----
area_4 = Area(Geometry=brep_4)
point_in_brep = PointInBrep(Brep=solid_union, Point=area_4, Strict=False)
cull_pattern = CullPattern(List=brep_4, CullPattern=point_in_brep)
brep_6 = Brep(simplify(cull_pattern))
weave = Weave(Pattern=larger_than.LargerThan, Stream0=brep_3, Stream1=brep_6, NullGaps=False)  # -> flatten(Weave)
project_3 = Project(Geometry=weave, Plane=PlaneXY(0, 0, 0))  # -> Geometry, Transform

# ----
# Scale down GDI Shape for Mask
# to cut away borders of prediction
number_slider = Slider(0.95, range=0..1)
area_5 = Area(Geometry=project_3.Geometry)  # -> Area, Centroid
scale_2 = Scale(Geometry=project_3.Geometry, Center=area_5.Centroid, Factor=number_slider)  # -> Geometry, Transform
fill = CreateGdiFill(Colour=hsv)
roomascrv = Curve(scale_2.Geometry)
shape = CreateGdiShape(Geometry=roomascrv, Fill=fill)

fill_2 = CreateGdiFill(Colour=hsv)
roomascrv_2 = Curve(project_3.Geometry)
scaled_gdi_shape = ClusterOutput(shape)
shape_2 = CreateGdiShape(Geometry=roomascrv_2, Fill=fill_2)
S = ClusterOutput(shape_2)
brep_edges = BrepEdges(Brep=project_3.Geometry)  # -> Naked, Interior, NonManifold
mesh = Mesh(project_3.Geometry)
mesh_2 = ClusterOutput(mesh)
roomedges = ClusterOutput(brep_edges.Naked)

# ==== cluster Cluster_3
brep = ClusterInput()
deconstruct_brep = DeconstructBrep(Brep=brep)  # -> Faces, Edges, Vertices
evaluate_surface = EvaluateSurface(Surface=deconstruct_brep.Faces, Point="0.5,0.5")  # -> Point, Normal, UDirection, VDirection, Frame
unit_z = UnitZ(Factor=1)
dot_product = DotProduct(VectorA=unit_z, VectorB=evaluate_surface.Normal, Unitize=False)
equality_within_tolerance = EqualityWithinTolerance(FirstNumber=dot_product, SecondNumber="0", Tolerance=0.1595272236)  # -> Equality, Inequality
equality_within_tolerance_2 = EqualityWithinTolerance(FirstNumber=dot_product, SecondNumber="-1", Tolerance=0.1595272236)  # -> Equality, Inequality
equality_within_tolerance_3 = EqualityWithinTolerance(FirstNumber=dot_product, SecondNumber="1", Tolerance=0.1595272236)  # -> Equality, Inequality

# ---- group: Wall
cull_pattern = CullPattern(List=deconstruct_brep.Faces, CullPattern=equality_within_tolerance.Equality)

# ----
cull_pattern_2 = CullPattern(List=deconstruct_brep.Faces, CullPattern=equality_within_tolerance_2.Equality)
vertical = ClusterOutput(cull_pattern)  # Vertical
bottom = ClusterOutput(cull_pattern_2)  # Bottom
cull_pattern_3 = CullPattern(List=deconstruct_brep.Faces, CullPattern=equality_within_tolerance_3.Equality)
top = ClusterOutput(cull_pattern_3)  # Top

# ==== cluster Cluster_4
roombrep = ClusterInput()  # RoomBREP
panel = Panel("""2
3""")
list = ClusterInput()
list_2 = ClusterInput()
brep = Brep(roombrep)
list_item = ListItem(List=list_2, Index=panel, Wrap=True)
list_item_2 = ListItem(List=list, Index=panel, Wrap=True)
brep_closest_point = BrepClosestPoint(Point=list_item_2, Brep=brep)  # -> Point, Normal, Distance
sort_list = SortList(Keys=brep_closest_point.Distance, ValuesCentroids=list_item_2, ValuesFaces=list_item)  # -> Keys, ValuesCentroids, ValuesFaces
number_slider = Slider(0.5, range=0..10)
construct_point = ConstructPoint(XCoordinate=number_slider, YCoordinate=number_slider, ZCoordinate=0)
list_item_3 = ListItem(List=sort_list.ValuesCentroids, Index="1", Wrap=True)
list_item_4 = ListItem(List=sort_list.ValuesFaces, Index="1", Wrap=True)
evaluate_surface = EvaluateSurface(Surface=reparameterize(list_item_4), Point=construct_point)  # -> Point, Normal, UDirection, VDirection, Frame
window_outside_face = ClusterOutput(list_item_3)
normal = ClusterOutput(evaluate_surface.Normal)

# ==== cluster Cluster_5
G = ClusterInput()
point = ClusterInput()
vector = ClusterInput()
input = ClusterInput()
orient = Orient_2(G_2=G, O=point, x=vector, G=input)  # -> G_3, orientation
orientation = ClusterOutput(orient.orientation)
frameratio = ClusterInput()
heightsilloverfloor = ClusterInput()
windowheight = ClusterInput()
panel = Panel("0.2")
panel_2 = Panel("5")
translation_vector = ClusterInput()
frameratio_2 = Data(frameratio)
windowheight_2 = Data(windowheight)
heightsilloverfloor_2 = Data(heightsilloverfloor)
dom = ConstructDomain(DomainStart="5000", DomainEnd="0")
dom_2 = ConstructDomain(DomainStart="5000", DomainEnd="200")
dom_3 = ConstructDomain(DomainStart="0", DomainEnd="1")
dom_4 = ConstructDomain(DomainStart="1", DomainEnd="0")
vector_2 = Vector(translation_vector)
remap = RemapNumbers(Value=heightsilloverfloor_2, Source=dom, Target=Domain(0, 1))  # -> Mapped, Clipped
remap_2 = RemapNumbers(Value=windowheight_2, Source=dom_2, Target=Domain(0, 1))  # -> Mapped, Clipped
remap_3 = RemapNumbers(Value=frameratio_2, Source=dom_3, Target=dom_4)  # -> Mapped, Clipped
windowsill = Brep(orient.G_3)
hsv = ColourHSV(Alpha="0.6", Hue=remap.Mapped, Saturation=remap_3.Mapped, Value=remap_2.Mapped)
windowsillcrv = Curve(windowsill)
move = Move(Geometry=windowsill, Motion=vector_2)  # -> Geometry, Transform
move_2 = Move(Geometry=windowsillcrv, Motion=vector_2)  # -> Geometry, Transform
C = ClusterOutput(hsv)
color_window = Colour(hsv)
windowsillmesh = Mesh(move.Geometry)
fill = CreateGdiFill(Colour=color_window)
shape = CreateGdiShape(Geometry=move_2.Geometry, Fill=fill)  # -> flatten(EncodedWindow)
encodedwindow = ClusterOutput(shape)
windowsillmesh_2 = ClusterOutput(windowsillmesh)

# ==== cluster Cluster_6
floors = ClusterInput()  # Floors
roofs = ClusterInput()  # Roofs
meshes = ClusterInput()
G = ClusterInput()
floor = ClusterInput()
window_vector = ClusterInput()
window_point = ClusterInput()
mesh_join = MeshJoin(Meshes=flatten(floors))
mesh_join_2 = MeshJoin(Meshes=flatten(roofs))
mesh_join_3 = MeshJoin(Meshes=flatten(meshes))
floor_2 = Brep(floor)
window_point_2 = Point(window_point)
window_vector_2 = Vector(window_vector)
orient = Orient_3(G_2=mesh_join_3, O=window_point_2, x=window_vector_2, G=floor_2)

# ---- group: Roofs
orient_2 = Orient_3(G_2=mesh_join_2, O=window_point_2, x=window_vector_2, G=floor_2)

# ----
orient_3 = Orient_3(G_2=window_point_2, O=window_point_2, x=window_vector_2, G=floor_2)

# ---- group: Floors
orient_4 = Orient_3(G_2=mesh_join, O=window_point_2, x=window_vector_2, G=floor_2)

# ----
pt = Point([Point(-12.7, -4.282661231, -1), Point(-12.5, -4.282661231, -1), Point(-12.3, -4.282661231, -1), Point(-12.1, -4.282661231, -1), Point(-11.9, -4.282661231, -1), Point(-11.7, -4.282661231, -1)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])

# ---- group: Reducing the Rays
cull_nth = CullNth(List=pt, CullFrequency=2)

# ----
pln = Plane(orient_3)
pt_2 = Point(Point(0, 0, -1))
mesh = Mesh(simplify(orient_4))
mesh_2 = Mesh(simplify(orient_2))
mesh_3 = Mesh(simplify(orient))
project = Project(Geometry=cull_nth, Plane=pln)  # -> Geometry, Transform
project_2 = Project(Geometry=pt_2, Plane=pln)  # -> Geometry, Transform
ln = Line(StartPoint=project.Geometry, EndPoint=project_2.Geometry)
Z = UnitZ(Factor=1)
list_length = ListLength(List=cull_nth)
mesh_4 = Mesh([mesh_2, mesh, mesh_3])
series = Series(Start=0, Step="1", Count="90")
pl = ConstructPlane(Origin=project_2.Geometry, XAxis=ln, YAxis=Z)
neg = Negative(Value=series)
rotate = Rotate(Geometry=ln, Angle=graft(degrees(neg)), Plane=pl)  # -> Geometry, Transform
vec = Vector(unitize(simplify(rotate.Geometry)))
multiplication = Multiplication(A=vec, B=1000)
move = Move(Geometry=project_2.Geometry, Motion=expr("-X", multiplication))  # -> Geometry, Transform

scale = Scale(Geometry=move.Geometry, Center=project_2.Geometry, Factor="1000")  # -> Geometry, Transform

ln_2 = Line(StartPoint=project_2.Geometry, EndPoint=scale.Geometry)  # -> simplify(Line)
flip = FlipMatrix(Data=ln_2)  # -> graft(Data)
intersection_points_as_output = BooleanToggle(False)
line = Line(flip)

# ---- group: For Debugging: All Rays in on Layer
panel = Panel("{31;*}")  # disabled
split_tree = SplitTree(Data=line, Masks=flatten(panel))  # -> Positive, Negative; disabled

# ----
# With Binary Search, all angles are counted up to the last piercing point.
# 
# Example: Last piercing point at beam 85 means 5 is written as the value, even if beams 88 and 89 do not hit a mesh. (Difference to training!)
ironpython_2_script = IronPython2Script(Meshes=mesh, Lines=line, CollectPoints=intersection_points_as_output)  # -> out, flatten(angleDurations), flatten(intersectionPoints); inputs Meshes: tree of Mesh, Lines: tree of Line, CollectPoints: Boolean
# ---------- ironpython_2_script: IronPython ----------
# coding=utf-8
"""
Blocking‑Angle Duration Finder (first‑hit mode)
==============================================
Rhino/Grasshopper Python script.

For every *(mesh_id, plane_idx)* pair it returns the number of consecutive
rays (angle indices 0–89) that **do** intersect the mesh, starting from the
*first* hit. 0 means full visibility / no blocking.

Inputs
------
Lines : DataTree of `rg.Line` (indexed by plane_idx, angle_idx)
Meshes: DataTree of `rg.Mesh` (indexed by mesh_id). *Optional* – if omitted,
        the script assumes free sight and outputs 0 for every plane.
CollectPoints (bool, optional): also store all intersection points in the
        blocking range.

Outputs
-------
angleDurations     : DataTree[int]   – blocking span length (0–90)
intersectionPoints : DataTree<Point3d> (only if CollectPoints)

Algorithm
---------
*Monotonic increase* assumption – if angle **X** hits, all larger angles hit.
A binary search on 0‑89 finds the first hit in O(log n) tests. Duration =
90 − firstHit. Points are gathered only if requested.

Free‑sight fallback
-------------------
When *no* valid meshes are supplied the script still emits a zero per plane
like the companion “last‑angle” script, so downstream components receive a
consistent tree structure.

"""

import Rhino.Geometry as rg
from Grasshopper import DataTree
from Grasshopper.Kernel.Data import GH_Path
import System
import System.Threading.Tasks as tasks
import System.Collections.Generic as generic
import threading

# ---------------------------------------------------------------------------
# CONFIG
# ---------------------------------------------------------------------------
MIN_IDX, MAX_IDX = 0, 89

# ---------------------------------------------------------------------------
# GLOBALS shared by worker threads
# ---------------------------------------------------------------------------
_lines      = {}                    # (plane_idx, angle_idx) → rg.Line
_results    = {}                    # (mesh_id, plane_idx)   → (duration, pts)
_lock       = threading.Lock()
_collect    = bool(globals().get("CollectPoints", False))

# ---------------------------------------------------------------------------
# HELPERS
# ---------------------------------------------------------------------------

def _geom(obj, t):
    """Extract a Rhino geometry object of type *t* from GH goo or None."""
    if obj is None:
        return None
    if isinstance(obj, t):
        return obj
    if hasattr(obj, "Value") and isinstance(obj.Value, t):
        return obj.Value
    return None


def _store(mid, pid, dur, pts):
    with _lock:
        _results[(mid, pid)] = (dur, pts)


def _worker(job):
    """Binary‑search worker for one (mesh, plane) pair."""
    mid, mesh, pid = job

    # Binary search for first hit
    lo, hi = MIN_IDX, MAX_IDX
    first  = MAX_IDX + 1           # sentinel → no hit
    while lo <= hi:
        mid_idx = (lo + hi) // 2
        ln      = _lines.get((pid, mid_idx))
        hit     = ln and rg.Intersect.Intersection.MeshLine(mesh, ln)
        if hit:
            first = mid_idx
            hi    = mid_idx - 1
        else:
            lo    = mid_idx + 1

    dur = 0
    pts = generic.List[rg.Point3d]()

    if first <= MAX_IDX:
        dur = (MAX_IDX + 1) - first  # how many angles are blocking
        if _collect:
            for idx in range(first, MAX_IDX + 1):
                ln = _lines.get((pid, idx))
                if ln:
                    hit_pts = rg.Intersect.Intersection.MeshLine(mesh, ln)
                    if hit_pts:
                        pts.AddRange(hit_pts)

    _store(mid, pid, dur, pts)

# ---------------------------------------------------------------------------
# 1. Parse Inputs
# ---------------------------------------------------------------------------
plane_ids = set()
if Lines and Lines.BranchCount:
    for i in range(Lines.BranchCount):
        p = Lines.Path(i)
        if p.Length >= 2:
            pid, aid = p.Indices[0], p.Indices[1]
            ln = _geom(Lines.Branch(p)[0], rg.Line)
            if ln:
                _lines[(pid, aid)] = ln
                plane_ids.add(pid)

plane_ids = sorted(plane_ids)

meshes = []
if Meshes and Meshes.BranchCount:
    for i in range(Meshes.BranchCount):
        m_path = Meshes.Path(i)
        mid    = m_path.Indices[0] if m_path.Length else i
        mesh   = _geom(Meshes.Branch(i)[0], rg.Mesh)
        if mesh:
            meshes.append((mid, mesh))

meshes_provided = bool(meshes)

# ---------------------------------------------------------------------------
# 2. Process
# ---------------------------------------------------------------------------
if not plane_ids:
    print("No valid Lines/planes – output trees stay empty.")
elif not meshes_provided:
    # Free‑sight fallback: duration 0 for every plane
    print("No meshes supplied – assuming free sight (duration 0).")
    dummy_id = 0
    for pid in plane_ids:
        _store(dummy_id, pid, 0, generic.List[rg.Point3d]())
else:
    jobs = [(mid, mesh, pid) for mid, mesh in meshes for pid in plane_ids]
    if jobs:
        tasks.Parallel.ForEach(jobs, _worker)

# ---------------------------------------------------------------------------
# 3. Assemble Outputs
# ---------------------------------------------------------------------------
angleDurationsTree     = DataTree[int]()
intersectionPointsTree = DataTree[rg.Point3d]()

for (mid, pid), (dur, pts) in _results.items():
    path = GH_Path(System.Array[System.Int32]([mid, pid]))
    angleDurationsTree.Add(dur, path)
    if pts.Count:
        intersectionPointsTree.AddRange(pts, path)

angleDurations     = angleDurationsTree
intersectionPoints = intersectionPointsTree

# ---------------------------------------------------------------------------
# 4. Console Feedback
# ---------------------------------------------------------------------------
if meshes_provided:
    print("Warning: Binary search assumes monotonicity – if angle X hits, all "
          "larger angles must hit as well.")
print("CollectPoints is {}.".format(_collect))
# ---------- end ironpython_2_script ----------

# ----
# Roofs and floor slabs were also integrated here, as it can happen in U-shaped buildings etc that roofs/storey ceilings shade the window.
intersection_points_as_output_2 = BooleanToggle(False)
ironpython_2_script_2 = IronPython2Script(Meshes=mesh_4, Lines=line, CollectPoints=intersection_points_as_output_2)  # -> out, flatten(lastAngleIndices), flatten(intersectionPoints); inputs Meshes: tree of Mesh, Lines: tree of Line, CollectPoints: Boolean
# ---------- ironpython_2_script_2: IronPython ----------
# coding=utf-8
"""
Last Angle Index Finder for Mesh–Plane Sweeps
============================================
Rhino/Grasshopper Python script.

Given:
- `Lines`  : Grasshopper DataTree of lines arranged by (plane_idx, angle_idx)
- `Meshes` : DataTree of meshes (mesh_id)
- `CollectPoints` (bool, optional): whether to collect intersection points

Returns:
- `lastAngleIndices`    : DataTree[int]  (mesh_id, plane_idx) → last intersecting angle index (0‑89)
- `intersectionPoints`  : DataTree[Point3d] with all points up to that angle (optional)

The algorithm assumes **monotonic visibility**:
if a line with angle X intersects the mesh, all smaller angles will too.
Therefore a binary search per mesh‑plane pair finds the highest angle that
still intersects.
"""

import Rhino.Geometry as rg
from Grasshopper import DataTree
from Grasshopper.Kernel.Data import GH_Path
import System
import System.Threading.Tasks as tasks
import System.Collections.Generic as generic
import threading

# --------------------------------------------------------------------------------------
# Configuration
# --------------------------------------------------------------------------------------
MIN_ANGLE_IDX, MAX_ANGLE_IDX = 0, 89        # inclusive bounds of angle indices

# --------------------------------------------------------------------------------------
# Globals (shared between worker threads)
# --------------------------------------------------------------------------------------
_lines      = {}                             # (plane_idx, angle_idx) → rg.Line
_results    = {}                             # (mesh_id, plane_idx)   → (last_idx, pts)
_results_lock = threading.Lock()
_collect_pts = False

# --------------------------------------------------------------------------------------
# Helpers
# --------------------------------------------------------------------------------------

def get_geometry(obj, target_type):
    """Extract a Rhino geometry object of *target_type* from various GH wrapper types.
    Returns the geometry or ``None`` if the conversion fails.
    """
    if obj is None:
        return None
    if isinstance(obj, target_type):
        return obj
    if hasattr(obj, "Value") and isinstance(obj.Value, target_type):
        return obj.Value
    if target_type is rg.Line:
        if isinstance(obj, rg.LineCurve):
            return obj.Line
        if hasattr(obj, "TryGetLine"):
            ok, ln = obj.TryGetLine()
            if ok:
                return ln
    return None


def _process_pair(pair):
    """Worker for one (mesh, plane) pair.
    Finds the last angle index whose line intersects *mesh*.
    """
    mesh_id, mesh, plane_idx = pair

    # Special case: no meshes supplied -> 'free sight'
    if mesh is None:
        _store_result(mesh_id, plane_idx, 0, generic.List[rg.Point3d]())
        return

    low, high = MIN_ANGLE_IDX, MAX_ANGLE_IDX
    last_hit  = -1

    while low <= high:
        mid = (low + high) // 2
        ln  = _lines.get((plane_idx, mid))
        hit = ln and rg.Intersect.Intersection.MeshLine(mesh, ln)
        if hit:
            last_hit = mid
            low      = mid + 1
        else:
            high     = mid - 1

    pts = generic.List[rg.Point3d]()
    if _collect_pts and last_hit >= 0:
        for idx in range(MIN_ANGLE_IDX, last_hit + 1):
            ln = _lines.get((plane_idx, idx))
            if ln:
                hit_pts = rg.Intersect.Intersection.MeshLine(mesh, ln)
                if hit_pts:
                    pts.AddRange(hit_pts)

    _store_result(mesh_id, plane_idx, max(last_hit, 0), pts)


def _store_result(mesh_id, plane_idx, last_idx, pts):
    key   = (mesh_id, plane_idx)
    value = (last_idx, pts)
    with _results_lock:
        _results[key] = value


# --------------------------------------------------------------------------------------
# 1. Parse Inputs
# --------------------------------------------------------------------------------------
# -- CollectPoints flag ---------------------------------------------------------------
_collect_pts = bool(globals().get("CollectPoints", False))

# -- Lines ---------------------------------------------------------------------------
plane_indices = set()
if Lines and Lines.BranchCount:
    for i in range(Lines.BranchCount):
        p = Lines.Path(i)
        if p.Length >= 2:
            plane_idx, angle_idx = p.Indices[0], p.Indices[1]
            ln = get_geometry(Lines.Branch(p)[0], rg.Line)
            if ln:
                _lines[(plane_idx, angle_idx)] = ln
                plane_indices.add(plane_idx)

plane_indices = sorted(plane_indices)

# -- Meshes --------------------------------------------------------------------------
valid_meshes = []
if Meshes and Meshes.BranchCount:
    for i in range(Meshes.BranchCount):
        mesh_path   = Meshes.Path(i)
        mesh_id     = mesh_path.Indices[0] if mesh_path.Length else i
        mesh        = get_geometry(Meshes.Branch(i)[0], rg.Mesh)
        if mesh:
            valid_meshes.append((mesh_id, mesh))

meshes_provided = bool(valid_meshes)

# --------------------------------------------------------------------------------------
# 2. Process
# --------------------------------------------------------------------------------------
if not plane_indices:
    print("No valid lines / planes found. Output trees are empty.")
elif not meshes_provided:
    # Free sight case: no meshes
    print("No meshes supplied – assuming free sight (index 0 for every plane).")
    dummy_id = 0
    for plane_idx in plane_indices:
        _store_result(dummy_id, plane_idx, 0, generic.List[rg.Point3d]())
else:
    # Build job list and run in parallel
    jobs = [(mid, mesh, pid) for mid, mesh in valid_meshes for pid in plane_indices]
    if jobs:
        tasks.Parallel.ForEach(jobs, _process_pair)

# --------------------------------------------------------------------------------------
# 3. Assemble Outputs
# --------------------------------------------------------------------------------------
lastAngleIndexTree     = DataTree[int]()
intersectionPointsTree = DataTree[rg.Point3d]()

for (mesh_id, plane_idx), (idx, pts) in _results.items():
    path = GH_Path(System.Array[System.Int32]([mesh_id, plane_idx]))
    lastAngleIndexTree.Add(idx, path)
    if pts.Count:
        intersectionPointsTree.AddRange(pts, path)

lastAngleIndices  = lastAngleIndexTree
intersectionPoints = intersectionPointsTree

# --------------------------------------------------------------------------------------
# 4. User Feedback
# --------------------------------------------------------------------------------------
if meshes_provided:
    print("Warning: Binary search assumes a monotonic hit function "
          "(if angle X hits, all smaller angles must hit too).")
# ---------- end ironpython_2_script_2 ----------
panel_2 = Panel("Section")
panel_3 = Panel("Top View")

partition_list = PartitionList(List=ironpython_2_script.angleDurations, Size=list_length)  # -> simplify(Chunks)
partition_list_2 = PartitionList(List=ironpython_2_script_2.lastAngleIndices, Size=list_length)  # -> simplify(Chunks)
avr = Average(Input=partition_list_2)
avr_2 = Average(Input=partition_list)
dom = ConstructDomain(DomainStart="0", DomainEnd=Slider(0.7, range=0..10))
dom_2 = ConstructDomain(DomainStart="70", DomainEnd="0")
remap = RemapNumbers(Value=partition_list_2, Source=Domain(90, 0), Target=Domain(0, 1))  # -> Mapped, Clipped
remap_2 = RemapNumbers(Value=partition_list, Source=dom_2, Target=dom)  # -> Mapped, Clipped
hsv = ColourHSV(Alpha="0.6", Hue=remap.Clipped, Saturation="1", Value=remap_2.Clipped)
contextpixelsascrv = ClusterInput()
expression = Expression(x=avr_2, Expression="Round(x,1)")
expression_2 = Expression(x=avr, Expression="Round(x,1)")
contextpixelsascrv_2 = Curve(reverse(contextpixelsascrv))
C = ClusterOutput(hsv)
R = ClusterOutput(expression_2)
R_2 = ClusterOutput(expression)
fill = CreateGdiFill(Colour=hsv)
project_3 = Project(Geometry=contextpixelsascrv_2, Plane=PlaneXY(0, 0, 0))  # -> Geometry, Transform
shape = CreateGdiShape(Geometry=project_3.Geometry, Fill=fill)
S = ClusterOutput(shape)

# ==== cluster Cluster_7
built_in_categories = BuiltInCategories("autodesk.revit.category.family:windows-1.0.0", SearchPattern="Window")
category_filter = CategoryFilter(Categories=built_in_categories, Inverted=False)
query_elements = QueryElements(Filter=category_filter)  # -> Elements, Count
component_neighbours = ComponentNeighbours(Component=query_elements.Elements)  # -> FromRoom, ToRoom
null_item = NullItem(Item=component_neighbours.FromRoom)  # -> NullFlags, InvalidFlags, Description
null_item_2 = NullItem(Item=component_neighbours.ToRoom)  # -> NullFlags, InvalidFlags, Description
gate_and = GateAnd(A=null_item.NullFlags, B=null_item_2.NullFlags)
gate_not = GateNot(A=gate_and)
cull_pattern = CullPattern(List=component_neighbours.FromRoom, CullPattern=gate_not)
cull_pattern_2 = CullPattern(List=component_neighbours.ToRoom, CullPattern=gate_not)
element_passport = ElementPassport(Element=cull_pattern)  # -> DocumentGUID, Document, UniqueID, Id
element_passport_2 = ElementPassport(Element=cull_pattern_2)  # -> DocumentGUID, Document, UniqueID, Id
cull_pattern_3 = CullPattern(List=query_elements.Elements, CullPattern=gate_not)
ids_fromroom = ClusterOutput(element_passport.Id)  # IDs_FromRoom
ids_toroom = ClusterOutput(element_passport_2.Id)  # IDs_ToRoom
windows = ClusterOutput(cull_pattern_3)  # Windows

# ==== cluster Cluster_8
relay = ClusterInput()
element_type = ElementType(Element=relay)  # -> Element, Type
parameter = ClusterInput()
element_parameter = ElementParameter(Element=element_type.Type, Parameter=parameter)  # -> Element, Value
pattern = ClusterInput()
match_text = MatchText(Text=element_parameter.Value, Pattern=pattern, Case=True)
cull_pattern = CullPattern(List=relay, CullPattern=match_text)
list = ClusterOutput(cull_pattern)

# ==== cluster Cluster_9
list = ClusterInput()
relay = ClusterInput()
element_location = ElementLocation(Element=relay)  # -> Element, Location, Hand, Facing, WorkPlane
element = ClusterInput()
element_location_2 = ElementLocation(Element=element)  # -> Element, Location, Hand, Facing, WorkPlane
angle = Angle(VectorA=element_location_2.Hand, VectorB=element_location.Hand)  # -> Angle, Reflex
degrees = Degrees(Radians=angle.Angle)
expression = Expression(x=degrees, Expression="x = 180")
expression_2 = Expression(x=degrees, Expression="x = 0")
gate_or = GateOr(A=expression_2, B=expression)
cull_pattern = CullPattern(List=relay, CullPattern=gate_or)
cull_pattern_2 = CullPattern(List=list, CullPattern=gate_or)
list_2 = ClusterOutput(cull_pattern)
list_3 = ClusterOutput(cull_pattern_2)

# ==== cluster Cluster_10
content = ClusterInput()
relay = ClusterInput()
bounding_box = BoundingBox(Content=content, Plane=PlaneXY(0, 0, 0), UnionBox=True)  # -> Box, Box_2
volume = Volume(Geometry=bounding_box.Box)  # -> Volume, Centroid
scale_x = ClusterInput()
scale_y = ClusterInput()
scale_nu = ScaleNU(Geometry=bounding_box.Box, Plane=volume.Centroid, ScaleX=scale_x, ScaleY=scale_y, ScaleZ=1)  # -> Geometry, Transform
element_bounding_geometry = ElementBoundingGeometry(Element=relay)
brep_brep = BrepBrep(BrepA=scale_nu.Geometry, BrepB=element_bounding_geometry)  # -> Curves, Points
list_length = ListLength(List=brep_brep.Curves)
boolean = Boolean(flatten(list_length))
cull_pattern = CullPattern(List=element_bounding_geometry, CullPattern=boolean)
cull_pattern_2 = CullPattern(List=relay, CullPattern=boolean)
list = ClusterOutput(cull_pattern_2)
list_2 = ClusterOutput(cull_pattern)

# ==== cluster Orient
O = ClusterInput()
x = ClusterInput()
Z = UnitZ(Factor=1)
G = ClusterInput()
neg = Negative(Value=x)
pl = ConstructPlane(Origin=O, XAxis=neg, YAxis=Z)
yz = YZPlane(Origin=Point(0, 0, 0))
G_2 = ClusterInput()
orient = Orient(Geometry=G, Source=pl, Target=yz)  # -> Geometry, Transform
orient_2 = Orient(Geometry=G_2, Source=pl, Target=yz)  # -> Geometry, Transform
transformation_matrix = ClusterOutput(orient.Transform)
area = Area(Geometry=orient.Geometry)  # -> Area, Centroid
pdecon = Deconstruct(Point=area.Centroid)  # -> XComponent, YComponent, ZComponent
neg_2 = Negative(Value=pdecon.ZComponent)
Z_2 = UnitZ(Factor=neg_2)
move = Move(Geometry=orient_2.Geometry, Motion=Z_2)  # -> Geometry, Transform
G_3 = ClusterOutput(move.Geometry)

# ==== cluster Orient_2
x = ClusterInput()
O = ClusterInput()
G = ClusterInput()
Z = UnitZ(Factor=1)
neg = Negative(Value=x)
pl = ConstructPlane(Origin=O, XAxis=neg, YAxis=Z)
yz = YZPlane(Origin=Point(0, 0, 0))
G_2 = ClusterInput()
orient = Orient(Geometry=G, Source=pl, Target=yz)  # -> Geometry, Transform
orient_2 = Orient(Geometry=G_2, Source=pl, Target=yz)  # -> Geometry, Transform
area = Area(Geometry=orient.Geometry)
pdecon = Deconstruct(Point=area)  # -> XComponent, YComponent, ZComponent
neg_2 = Negative(Value=pdecon.ZComponent)
Z_2 = UnitZ(Factor=neg_2)
move = Move(Geometry=orient_2.Geometry, Motion=Z_2)  # -> Geometry, Transform
brep = Brep(move.Geometry)
orientation = ClusterOutput(orient_2.Transform)  # Orientation
G_3 = ClusterOutput(move.Geometry)

# ==== cluster Orient_3
O = ClusterInput()
x = ClusterInput()
G = ClusterInput()
neg = Negative(Value=x)
Z = UnitZ(Factor=1)
pl = ConstructPlane(Origin=O, XAxis=neg, YAxis=Z)
G_2 = ClusterInput()
yz = YZPlane(Origin=Point(0, 0, 0))
orient = Orient(Geometry=G, Source=pl, Target=yz)  # -> Geometry, Transform
orient_2 = Orient(Geometry=G_2, Source=pl, Target=yz)  # -> Geometry, Transform
area = Area(Geometry=orient.Geometry)  # -> Area, Centroid
pdecon = Deconstruct(Point=area.Centroid)  # -> XComponent, YComponent, ZComponent
neg_2 = Negative(Value=pdecon.ZComponent)
Z_2 = UnitZ(Factor=neg_2)
move = Move(Geometry=orient_2.Geometry, Motion=Z_2)  # -> Geometry, Transform
G_3 = ClusterOutput(move.Geometry)
